# Grasshopper definition servoj_ghScript_proxy.gh (Grasshopper 1.0.8)
# plug-ins: Robots, RobotsExtended, treesloth01, Anemone, Opossum2_0_Proto_A

# ----
# Load Robot
list = RobotsLibrary({"UR3e", "UR5e", "UR10e", "UR16e", "UR3", "UR5", "UR10", "UR20", "UR30"}, selected="UR5", Type=0)
load_robot_system = LoadRobotSystem(Name=list, Base=PlaneXY(0, 0, 0))
robotsystem_parameter = RobotSystemParameter(load_robot_system)

# ----
# Send to Robot
choose_a_robot = ValueList({"Robotarm": 0, "Robotarm 2": 1}, selected="Robotarm")
robotarm_ip_address = Panel("172.19.126.241")
robotarm_2_ip_address = Panel("172.19.126.245")
stream_filter = StreamFilter(Gate=choose_a_robot, Stream0=robotarm_ip_address, Stream1=robotarm_2_ip_address)
robot_ip_txt = Text(stream_filter)

# ---- group: Get Data From RObot
get_robot_position = Button()
robot_ip_txt_2 = Text(robot_ip_txt)
get_robot_position_2 = Script(run=get_robot_position, ip_address=robot_ip_txt_2)  # -> tcp, tool; inputs run: Boolean, ip_address: String
# ---------- get_robot_position_2: Python ----------
import socket
import struct
import math
from datetime import datetime

def connect_to_ur_robot(host, port=30002):
    try:
        s = socket.create_connection((host, port), timeout=3.0)
        print(f"Connected to UR robot at {host}:{port}")
        return s
    except Exception as e:
        now = datetime.now()
        print(f"{now:%Y-%m-%d/%H:%M:%S}: Failed to connect to UR robot: {e}")
        return None

def parse_info(data):
    """Parses Cartesian info and tool offsets from the robot's data."""
    try:
        header_size = 5
        if len(data) > header_size:
            size, ptype = struct.unpack("!iB", data[:header_size])
            print(ptype, size)
            if ptype == 16: 
                print("Received Robot State Message" , size)
                data = data[header_size:]
                while data: 
                    print("Subpackage", "remaining data:", len(data))
                    size, ptype = struct.unpack("!iB", data[:header_size])
                    print("Subpackage type: ", ptype, size)
                    if ptype == 4: # Cartesian Information
                        format_str = "!dddddddddddd"
                        unpacked = struct.unpack(format_str, data[header_size:header_size + struct.calcsize(format_str)])
                        print(unpacked)
                        cartesian_info = {
                            "X": unpacked[0], "Y": unpacked[1], "Z": unpacked[2],
                            "Rx": unpacked[3], "Ry": unpacked[4], "Rz": unpacked[5],
                            "tcpOffsetX": unpacked[6], "tcpOffsetY": unpacked[7], "tcpOffsetZ": unpacked[8],
                            "tcpOffsetRx": unpacked[9], "tcpOffsetRy": unpacked[10], "tcpOffsetRz": unpacked[11]
                        }
                        print(cartesian_info)

                        return (unpacked[:6], unpacked[6:])
                    elif ptype == 1:
                        """print(size)
                        format_str = "!dddddddddddd"
                        unpacked = struct.unpack(format_str, data[header_size:header_size + struct.calcsize(format_str)])
                        print(unpacked)
                        print("sdfs")
                        joint_info = {
                            "J0": math.degrees(unpacked[0]), "J1": math.degrees(unpacked[1]), "J2": math.degrees(unpacked[2]),
                            "J3": math.degrees(unpacked[3]), "J4": math.degrees(unpacked[4]), "J5": math.degrees(unpacked[5]),
                            "AJ0": math.degrees(unpacked[6]), "AJ1": math.degrees(unpacked[7]), "AJ2": math.degrees(unpacked[8]),
                            "AJ3": math.degrees(unpacked[9]), "AJ4": math.degrees(unpacked[10]), "AJ5": math.degrees(unpacked[11])
                        }
                        print(joint_info)
                        print("SSSSS"*20)
                        format_str = "!dddffffB dddffffB dddffffB dddffffB dddffffB dddffffB"
                        unpacked = struct.unpack(format_str, data[header_size:header_size + struct.calcsize(format_str)])
                        print(unpacked)
                        joint_info = {
                            "J0": math.degrees(unpacked[0]), "J1": math.degrees(unpacked[1]), "J2": math.degrees(unpacked[2]),
                            "J3": math.degrees(unpacked[3]), "J4": math.degrees(unpacked[4]), "J5": math.degrees(unpacked[5]),
                            "AJ0": math.degrees(unpacked[6]), "AJ1": math.degrees(unpacked[7]), "AJ2": math.degrees(unpacked[8]),
                            "AJ3": math.degrees(unpacked[9]), "AJ4": math.degrees(unpacked[10]), "AJ5": math.degrees(unpacked[11])
                        }
                        print(joint_info)
                        exit()"""
                        pass
                    data = data[size : ]

    except Exception as e:
        print(f"Error parsing Cartesian info: {e}")
    return None

def get_tcp_and_tool_offsets(robot_socket):
    """Requests and retrieves TCP position and tool offsets from the robot."""
    try:
        #while True:
        for i in range(5):
            data = robot_socket.recv(4096)
            if not data:
                break

            cartesian_info = parse_info(data)
            if cartesian_info:
                tcp_position, tool_config = cartesian_info
                print(f"TCP Position: {tcp_position}")
                print(f"Tool Offsets: {tool_config}")
                return tcp_position, tool_config
                break
            else:
                print("No Cartesian info found in the data")
        
        # if none found
        return None, None

    except Exception as e:
        print(f"Error retrieving data from the robot: {e}")

def connect_and_get(IP):
    host = IP  # Replace with your robot's IP address
    robot_socket = connect_to_ur_robot(host)

    if robot_socket:
        tcp , tool = get_tcp_and_tool_offsets(robot_socket)
        robot_socket.close()
        return tcp, tool


tcp, tool = connect_and_get(ip_address)
tcp = [x for x in tcp]
tool = [x for x in tool]
# ---------- end get_robot_position_2 ----------
robot_tcp_numbers = Number(get_robot_position_2.tcp)
tool_tcp_numbers = Number(get_robot_position_2.tool)

# ----
button = Button()  # disabled
unit_x = UnitX(Factor=1)
unit_y = UnitY(Factor=1)

# ----
# Tool: modular 0
brep = Brep([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])
unit_z = UnitZ(Factor=-1)
unit_x_2 = UnitX(Factor=1)
# Tool Generation
point = Point(Point(-80.34, 0, 125.52))
solid_union = SolidUnion(Breps=brep)
mesh_brep = MeshBrep(
    Brep=solid_union,
    Settings={GridMaxCount=0, GridMinCount=16, JaggedSeams=False, MaxEdgeLength=0, MinEdgeLength=0.0001, MinTolerance=0, Refine=True, RefineAngle=0, RelativeTolerance=0.65, SimplePlanes=True, Tolerance=0})
construct_plane = ConstructPlane(Origin=point, XAxis=unit_x_2, YAxis=unit_z)
mesh_join = MeshJoin(Meshes=mesh_brep)
volume = Volume(Geometry=mesh_join)  # -> Volume, Centroid
create_tool = CreateTool(Name="UR5_modular_0", TCP=construct_plane, Weight="0.32", Centroid=volume.Centroid, Mesh=mesh_join)  # -> Tool, TCP
update_tool = UpdateTool(GH_Tool=create_tool.Tool, TCP=create_tool.TCP, IsCtrl=False)

# ----
# Tool: modular 45
brep_2 = Brep([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])
unit_z_2 = UnitZ(Factor=-1)
brep_3 = Brep([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])
unit_x_3 = UnitX(Factor=-1)
point_2 = Point(Point(80.34, 0, 125.52))
solid_union_2 = SolidUnion(Breps=brep_3)
construct_plane_2 = ConstructPlane(Origin=point_2, XAxis=unit_z_2, YAxis=unit_x_3)
mesh_brep_2 = MeshBrep(
    Brep=solid_union_2,
    Settings={GridMaxCount=0, GridMinCount=16, JaggedSeams=False, MaxEdgeLength=0, MinEdgeLength=0.0001, MinTolerance=0, Refine=True, RefineAngle=0, RelativeTolerance=0.65, SimplePlanes=True, Tolerance=0})
rotate_plane = RotatePlane(Plane=construct_plane_2, Angle=degrees(-45))
mesh_join_2 = MeshJoin(Meshes=mesh_brep_2)
volume_2 = Volume(Geometry=mesh_join_2)  # -> Volume, Centroid
create_tool_2 = CreateTool(Name="UR5_modular_45", TCP=rotate_plane, Weight="0.39", Centroid=volume_2.Centroid, Mesh=mesh_join_2)  # -> Tool, TCP
update_tool_2 = UpdateTool(GH_Tool=create_tool_2.Tool, TCP=create_tool_2.TCP, IsCtrl=False)

# ----
# Tool: modular 90
brep_4 = Brep([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])
point_3 = Point(Point(-80.34, 0, 125.52))
unit_x_4 = UnitX(Factor=1)
unit_z_3 = UnitZ(Factor=-1)
solid_union_3 = SolidUnion(Breps=brep_4)
mesh_brep_3 = MeshBrep(
    Brep=solid_union_3,
    Settings={GridMaxCount=0, GridMinCount=16, JaggedSeams=False, MaxEdgeLength=0, MinEdgeLength=0.0001, MinTolerance=0, Refine=True, RefineAngle=0, RelativeTolerance=0.65, SimplePlanes=True, Tolerance=0})
construct_plane_3 = ConstructPlane(Origin=point_3, XAxis=unit_z_3, YAxis=unit_x_4)
mesh_join_3 = MeshJoin(Meshes=mesh_brep_3)
volume_3 = Volume(Geometry=mesh_join_3)  # -> Volume, Centroid
create_tool_3 = CreateTool(Name="UR5_modular_90", TCP=construct_plane_3, Weight="0.4", Centroid=volume_3.Centroid, Mesh=mesh_join_3)  # -> Tool, TCP
update_tool_3 = UpdateTool(GH_Tool=create_tool_3.Tool, TCP=create_tool_3.TCP, IsCtrl=False)

# ----
# Set Start Pose
# Comment: Set the Joint angles of the robot at the start of the Program.
joint_2_shoulder = Slider(-1.57, range=-6.28..6)
# Simulation and Motion Testing
joint_1_base = Slider(1.57, range=0..6)
joint_3_elbow = Slider(1.57, range=0..6)
joint_4_wrist_1 = Slider(0, range=-3.14..3.14)
joint_5_wrist_2 = Slider(1.57, range=-3.14..3.14)
joint_6_wrist_3 = Slider(3.14, range=0..6)
merge = Merge(
    Data1=joint_1_base,
    Data2=joint_2_shoulder,
    Data3=joint_3_elbow,
    Data4=joint_4_wrist_1,
    Data5=joint_5_wrist_2,
    Data6=joint_6_wrist_3)
text_join = TextJoin(Text=merge, Join=",")
create_target = CreateTarget(Joints=text_join, IsCartesian=False)

# ----
# Import Model Waypoints
elevation = Slider(0.3, range=0..50)
panel = Panel("C:\Users\pjvth\High-tech Engineering\Thesis\Non-Planar Models\Arc\Arc new format\Arc_scaled.txt")
line_width = Slider(0.4, range=0..3)
brim_count = Slider(12, range=0..25)
line_count = Slider(3, range=1..10)
scaling_factor = Slider(0.5, range=0..1)
number_slider = Slider(259, range=0..2000)
number_slider_2 = Slider(190, range=0..2000)
python_3_script = Python3Script(filepath=panel, elevation=elevation, line_width=line_width, line_count=line_count, brim_count=brim_count)  # -> lines, section_heights, section_distances; inputs filepath: String, line_width: Double, line_count: Int32, brim_count: Int32
# ---------- python_3_script: Python ----------
import math
import Rhino.Geometry as rg
import Grasshopper as gh
from collections import defaultdict
from itertools import groupby
import ghpythonlib.treehelpers as th

# ─────────────────────────────────────────────
# CONSTANTS
# ─────────────────────────────────────────────
BRIDGE_CLEARANCE  = 3.0   # mm above highest point of the two bridged polylines
BRIDGE_PT_SPACING = 3.0   # approximate waypoint spacing along the bridge (mm)
LAYER_IS_BRIDGE   = "bridge"
LAYER_IS_BASE     = "base"
LAYER_IS_MODEL    = "model"

# ─────────────────────────────────────────────
# PARSER
# ─────────────────────────────────────────────

def parse_layers_from_txt(filepath):
    entries = []

    with open(filepath, 'r') as f:
        lines = f.readlines()

    file_layer_idx = -1
    poly_idx       = -1
    current_pts    = []
    current_lh     = []
    in_data        = False

    def flush_poly():
        if current_pts:
            entries.append({
                'points'      : list(current_pts),
                'thicknesses' : list(current_lh),
                'file_layer'  : file_layer_idx,
                'poly_index'  : poly_idx,
            })

    for raw in lines:
        line = raw.strip()
        if not line:
            continue

        if line.startswith("Nodes on the"):
            flush_poly()
            current_pts    = []
            current_lh     = []
            in_data        = False
            file_layer_idx += 1
            poly_idx        = -1
            continue

        if line.startswith("Polyline"):
            flush_poly()
            current_pts = []
            current_lh  = []
            in_data     = False
            poly_idx   += 1
            continue

        if line == "x y thickness":
            in_data = True
            continue

        if in_data:
            parts = line.split()
            if len(parts) == 3:
                try:
                    x  = float(parts[0])
                    z  = float(parts[1]) + elevation   # file Y → world Z
                    lh = float(parts[2])
                    pt = [x, 0.0, z]

                    current_pts.append(pt)
                    current_lh.append(lh)
                except ValueError:
                    pass

    flush_poly()
    return entries

# ─────────────────────────────────────────────
# GEOMETRY / OUTPUT HELPERS
# ─────────────────────────────────────────────

def get_brim_offsets(is_first_layer, line_count, brim_count):
    if is_first_layer:
        return (
            list(range(-brim_count, 0)) +
            list(range(0, line_count)) +
            list(range(line_count, line_count + brim_count))
        )
    else:
        return list(range(0, line_count))

def make_polyline_rg(pts_base, y_offset_index, y_spacing, reverse):
    pts = [rg.Point3d(pt.X, pt.Y + y_offset_index * y_spacing, pt.Z)
           for pt in pts_base]
    if reverse:
        pts = list(reversed(pts))
    return rg.Polyline(pts)

def compute_waypoint_distances(rg_polyline):
    pts = list(rg_polyline)
    n   = len(pts)
    if n < 2:
        return [0.0] * n
    dists = []
    for i in range(n - 1):
        d = math.sqrt(
            (pts[i+1].X - pts[i].X)**2 +
            (pts[i+1].Y - pts[i].Y)**2 +
            (pts[i+1].Z - pts[i].Z)**2
        )
        dists.append(d)
    dists.append(0.0)
    return dists

def find_outermost_base_points(layers):
    left_point  = None
    right_point = None
    for layer in layers:
        lp = min(layer, key=lambda p: p[0])
        rp = max(layer, key=lambda p: p[0])
        if left_point is None or lp[2] <= left_point[2]:
            left_point = lp
        if right_point is None or rp[2] <= right_point[2]:
            right_point = rp
    return left_point, right_point

# ─────────────────────────────────────────────
# MAIN
# ─────────────────────────────────────────────

entries = parse_layers_from_txt(filepath)

all_lh = [lh for e in entries for lh in e['thicknesses']]
mean_layer_height = sum(all_lh) / len(all_lh) if all_lh else 0.5*line_width

y_spacing    = 0.35
x_pt_spacing = 2.0

# Extract point lists from the entries dictionaries to feed into the new function
point_layers = [e['points'] for e in entries]
left_point, right_point = find_outermost_base_points(point_layers)

x_left  = left_point[0]
x_right = right_point[0]
y_base  = entries[0]['points'][0][1]

# Base X grid
x_span    = x_right - x_left
num_x_pts = max(2, int(round(x_span / x_pt_spacing)) + 1)
x_coords  = [x_left + i * (x_span / (num_x_pts - 1)) for i in range(num_x_pts)]

# Base Z levels (Builds downwards up to the specified elevation distance)
start_z = min(left_point[2], right_point[2])
target_bottom_z = max(0.0, start_z - elevation) # Calculate target depth, clamped at 0

z_coords = []
z = start_z
while z >= target_bottom_z - 1e-9: 
    z_coords.append(round(z, 6))
    z -= mean_layer_height

# Reverse the list so the physical toolpath prints from the bottom upwards
z_coords.reverse()

base_lh = 0.5 * line_width

# ─────────────────────────────────────────────
# CONTINUOUS STATE MACHINE
# ─────────────────────────────────────────────
section_lines     = []
section_heights   = gh.DataTree[object]()
section_distances = gh.DataTree[object]()
nested            = []

current_side = 'L'
layer_idx = 0

# --- 1. BASE LAYERS ---
for i, z in enumerate(z_coords):
    pts_raw = [[x, y_base, z] for x in x_coords]
    thicknesses = [base_lh] * len(pts_raw)

    offsets = get_brim_offsets(i == 0, line_count, brim_count)

    # Alternate offsets per layer
    if i % 2 == 0:
        ordered_offsets = sorted(offsets)
    else:
        ordered_offsets = sorted(offsets, reverse=True)

    branch = []
    for visit_index, offset in enumerate(ordered_offsets):
        do_reverse = (current_side == 'R')

        rg_pts = [rg.Point3d(p[0], p[1], p[2]) for p in pts_raw]
        poly_rg = make_polyline_rg(rg_pts, offset, y_spacing, reverse=do_reverse)
        branch.append(poly_rg)

        lh_ordered = list(reversed(thicknesses)) if do_reverse else list(thicknesses)
        dists = compute_waypoint_distances(poly_rg)

        path = gh.Kernel.Data.GH_Path(layer_idx, visit_index)
        section_heights.AddRange(lh_ordered, path)
        section_distances.AddRange(dists, path)

        current_side = 'R' if current_side == 'L' else 'L'

    section_pts = [rg.Point3d(p[0], 0.0, p[2]) for p in pts_raw]
    section_lines.append(rg.Polyline(section_pts))

    nested.append(branch)
    layer_idx += 1


# --- 2. MODEL LAYERS ---
current_model_offset = 0

grouped = []
for _, grp in groupby(entries, key=lambda e: e['file_layer']):
    grouped.append(list(grp))

for group in grouped:
    # Sort order depends on where the tool currently is
    if current_side == 'L':
        group_sorted = sorted(group, key=lambda e: min(p[0] for p in e['points']))
    else:
        group_sorted = sorted(group, key=lambda e: min(p[0] for p in e['points']), reverse=True)

    # Force all core coordinates to be canonical L→R
    canonical_group = []
    for e in group_sorted:
        pts_c = list(e['points'])
        lh_c  = list(e['thicknesses'])
        if pts_c[-1][0] < pts_c[0][0]:
            pts_c = list(reversed(pts_c))
            lh_c  = list(reversed(lh_c))
        canonical_group.append({
            'points'      : pts_c,
            'thicknesses' : lh_c
        })

    # Process polylines
    for i, poly in enumerate(canonical_group):
        pts_raw = poly['points']
        thicknesses = poly['thicknesses']

        section_pts = [rg.Point3d(p[0], 0.0, p[2]) for p in pts_raw]
        section_lines.append(rg.Polyline(section_pts))

        # Maintain continuity: start at whichever Y-offset the previous polyline ended at
        if current_model_offset == 0:
            poly_offsets = list(range(line_count))
        else:
            poly_offsets = list(reversed(range(line_count)))

        branch = []
        for visit_index, offset in enumerate(poly_offsets):
            do_reverse = (current_side == 'R')

            rg_pts = [rg.Point3d(p[0], p[1], p[2]) for p in pts_raw]
            poly_rg = make_polyline_rg(rg_pts, offset, y_spacing, reverse=do_reverse)
            branch.append(poly_rg)

            lh_ordered = list(reversed(thicknesses)) if do_reverse else list(thicknesses)
            dists = compute_waypoint_distances(poly_rg)

            path = gh.Kernel.Data.GH_Path(layer_idx, visit_index)
            section_heights.AddRange(lh_ordered, path)
            section_distances.AddRange(dists, path)

            # Flip tool side after every line
            current_side = 'R' if current_side == 'L' else 'L'

        nested.append(branch)
        current_model_offset = poly_offsets[-1]
        layer_idx += 1

        # Travel Bridge handling
        if i < len(canonical_group) - 1:
            next_poly = canonical_group[i + 1]
            
            # Since we jump the gap to the adjacent polyline, the tool ends up on the opposite side
            next_side = 'L' if current_side == 'R' else 'R'

            start_pt_rg = branch[-1].Last
            max_z = max(max(p[2] for p in pts_raw), max(p[2] for p in next_poly['points']))
            z_bridge = max_z + BRIDGE_CLEARANCE

            if next_side == 'L':
                end_p_raw = next_poly['points'][0]
            else:
                end_p_raw = next_poly['points'][-1]

            end_pt_rg = rg.Point3d(
                end_p_raw[0],
                end_p_raw[1] + current_model_offset * y_spacing,
                z_bridge
            )

            start_up = rg.Point3d(start_pt_rg.X, start_pt_rg.Y, z_bridge)
            end_up   = end_pt_rg

            dist = start_up.DistanceTo(end_up)
            n_steps = max(1, int(math.ceil(dist / BRIDGE_PT_SPACING))) if dist > 1e-6 else 1

            bridge_pts_rg = []
            for s in range(n_steps + 1):
                t = s / float(n_steps)
                px = start_up.X + t * (end_up.X - start_up.X)
                py = start_up.Y + t * (end_up.Y - start_up.Y)
                bridge_pts_rg.append(rg.Point3d(px, py, z_bridge))

            bridge_poly_rg = rg.Polyline(bridge_pts_rg)

            bridge_branch = [bridge_poly_rg]
            path = gh.Kernel.Data.GH_Path(layer_idx, 0)
            section_heights.AddRange([0.0] * len(bridge_pts_rg), path) # Thickness is 0 for bridges
            section_distances.AddRange(compute_waypoint_distances(bridge_poly_rg), path)

            nested.append(bridge_branch)

            bridge_section_pts = [rg.Point3d(p.X, 0.0, p.Z) for p in bridge_pts_rg]
            section_lines.append(rg.Polyline(bridge_section_pts))

            layer_idx += 1
            current_side = next_side

# ─────────────────────────────────────────────
# Output as GH DataTree
# ─────────────────────────────────────────────
lines = th.list_to_tree(nested)
# ---------- end python_3_script ----------
construct_domain = ConstructDomain(DomainStart=number_slider_2, DomainEnd=number_slider)
subtraction = Subtraction(A=number_slider, B=number_slider_2)
curve = Curve(simplify(python_3_script.lines))
multiplication = Multiplication(A=python_3_script.section_heights, B=scaling_factor)
scale = Scale(Geometry=python_3_script.lines, Center=Point(0, 0, 0), Factor=scaling_factor)  # -> Geometry, Transform
multiplication_2 = Multiplication(A=python_3_script.section_distances, B=scaling_factor)
value_list = ValueList({"25%": 0.25, "50%": 0.5, "75%": 0.75, "100%": 1}, selected="100%")
list_length = ListLength(List=flatten(curve))
range = Range(Domain=construct_domain, Steps=subtraction)
tree_statistics = TreeStatistics(Tree=curve)  # -> Paths, Length, Count
multiplication_3 = Multiplication(A=list_length, B=value_list)
list_item = ListItem(List=tree_statistics.Paths, Index=range, Wrap=True)
split_tree = SplitTree(Data=curve, Masks=list_item)  # -> Positive, Negative
split_list = SplitList(List=flatten(curve), Index=multiplication_3)  # -> ListA, ListB
stream_filter_2 = StreamFilter(Gate=2, Stream0=split_tree.Positive, Stream1=split_list.ListA, Stream2=scale.Geometry)
curve_2 = Curve(stream_filter_2)
unit_x_5 = UnitX(Factor=1)
control_points = ControlPoints(Curve=stream_filter_2)  # -> simplify(Points), Weights, Knots
explode = Explode(Curve=stream_filter_2, Recursive=True)  # -> simplify(Segments), Vertices
line_sdl = LineSDL(Start=control_points.Points, Direction=unit_x_5, Length=1)
yz_plane = YZPlane(Origin=Point(0, 0, 0))
flip_curve = FlipCurve(Curve=explode.Segments, Guide=line_sdl)  # -> Curve, Flag
data_dam = DataDam(DataDataA=stream_filter_2, BufferDelay=10000000, BufferMode=0)

construct_domain_2 = ConstructDomain(DomainStart=expr("x*0.2", line_width), DomainEnd=expr("x*0.8", line_width))
clamp = Clamp(Value=multiplication, Domain=construct_domain_2)

# ----
# Check Printbed Collision
number_slider_3 = Slider(40, range=30..50)  # disabled
deconstruct_vector = DeconstructVector(Vector=explode.Vertices)  # -> XComponent, YComponent, flatten(ZComponent); disabled
number_slider_4 = Slider(48, range=30..50)  # disabled
unit_x_6 = UnitX(Factor=1)  # disabled
angle = Angle(VectorA=flip_curve.Curve, VectorB=unit_x_6)  # -> flatten(Angle), Reflex; disabled
bounds = Bounds(Numbers=deconstruct_vector.ZComponent)  # disabled
deconstruct_domain = DeconstructDomain(Domain=bounds)  # -> Start, End; disabled
radians = Radians(Degrees=number_slider_4)  # disabled
subtraction_2 = Subtraction(A=deconstruct_vector.ZComponent, B=deconstruct_domain.Start)  # disabled
minimum = Minimum(A=subtraction_2, B=number_slider_3)  # disabled
colour_swatch = ColourSwatch(SwatchColor=RGB(38, 238, 255))  # disabled
expression = Expression(h=minimum, R=number_slider_3, theta=radians, Expression="(alpha + Asin(h / (R * cos(alpha))))")  # disabled
larger_than = LargerThan(FirstNumber=angle.Angle, SecondNumber=expression)  # -> LargerThan, OrEqualTo; disabled
cull_pattern = CullPattern(List=flatten(flip_curve.Curve), CullPattern=larger_than.LargerThan)  # disabled
custom_preview = CustomPreview(Geometry=cull_pattern, Material=colour_swatch)  # disabled

angle_2 = Angle(VectorA=flip_curve.Curve, VectorB=unit_x)  # -> Angle, Reflex
blur_numbers = BlurNumbers(Numbers=angle_2.Angle, Strength=0.5, Iterations=1, Lock=True, Wrap=False)
rotate = Rotate(Vector=unit_x, Axis=unit_y, Angle=blur_numbers)  # -> simplify(Vector)
stream_filter_3 = StreamFilter(Gate=1, Stream0=flip_curve.Curve, Stream1=rotate)

plane_normal = PlaneNormal(Origin=control_points.Points, ZAxis=stream_filter_3)
align_planes = AlignPlanes(Planes=plane_normal, Master=yz_plane)
polyline_planes = Plane(align_planes)
data_dam_2 = DataDam(DataDataA=polyline_planes, BufferDelay=10000000, BufferMode=0)

# ----
# Define Buildplate
image_sampler = ImageSampler(Filter="Colour", Interpolate=False, Umax=1, Umin=0, Vmax=1, Vmin=0, Wrap=1)
robotsystem_parameter_2 = RobotSystemParameter(robotsystem_parameter)

# ----
# Point Right
tool_position_in_base = Panel("""-0.256879
-0.232042
0.046378
1.29299
-1.198608
-1.201483""")
get_plane = GetPlane(Numbers=tool_position_in_base, RobotSystem=robotsystem_parameter_2)
point_right_plane = Plane(get_plane)

# ----
# Origin
tool_position_in_base_2 = Panel("""-0.307127
-0.78303
0.048178
1.536888
-0.111609
-0.403582""")
get_plane_2 = GetPlane(Numbers=tool_position_in_base_2, RobotSystem=robotsystem_parameter_2)
origin_plane = Plane(get_plane_2)

# ----
# Point Down
tool_position_in_base_3 = Panel("""0.27913
-0.77722
0.046288
1.519681
0.43572
0.171683""")
get_plane_3 = GetPlane(Numbers=tool_position_in_base_3, RobotSystem=robotsystem_parameter_2)
point_down_plane = Plane(get_plane_3)

# ----
# Check Workpiece Collision
renumber_paths = RenumberPaths(Data=stream_filter_3)  # -> flatten(RenumberedData); disabled
unit_y_2 = UnitY(Factor=1)  # disabled
sine = Sine(Value=degrees(number_slider_4))  # disabled
renumber_paths_2 = RenumberPaths(Data=control_points.Points)  # -> flatten(RenumberedData); disabled
rotate_2 = Rotate(Vector=renumber_paths, Axis=unit_y_2, Angle=expr("pi-x", number_slider_4))  # disabled
rotate_3 = Rotate(Vector=renumber_paths, Axis=unit_y_2, Angle=number_slider_4)  # disabled
division = Division(A=number_slider_3, B=sine)  # disabled
line_sdl_2 = LineSDL(Start=renumber_paths_2, Direction=rotate_2, Length=division)  # disabled
line_sdl_3 = LineSDL(Start=renumber_paths_2, Direction=rotate_3, Length=division)  # disabled
colour_swatch_2 = ColourSwatch(SwatchColor=RGB(0, 255, 21))  # disabled

list_length_2 = ListLength(List=renumber_paths)  # -> expr("x-1", Length); disabled
loop_start = LoopStart(Repeat=list_length_2, Trigger=button, Data=renumber_paths)  # -> port, Counter, Data; disabled
panel_2 = Panel(loop_start.Counter)  # disabled
list_item_2 = ListItem(List=line_sdl_3, Index=loop_start.Counter, Wrap=False)  # disabled
list_item_3 = ListItem(List=line_sdl_2, Index=loop_start.Counter, Wrap=False)  # disabled

# ----
# Measure TCP
# Comment: The Tool TCP Of your Probe
tool_tcp = Panel(tool_tcp_numbers)
robot_tcp_numbers_2 = Number(robot_tcp_numbers)
tool_tcp_numbers_2 = Number(tool_tcp_numbers)
tcp_probe = Panel("""0.00
-0.08034
0.12552
0
0
0""")
robotsystem_parameter_3 = RobotSystemParameter(robotsystem_parameter)

get_plane_4 = GetPlane(Numbers=tcp_probe, RobotSystem=robotsystem_parameter_3)
get_plane_5 = GetPlane(Numbers=tool_tcp_numbers_2, RobotSystem=robotsystem_parameter_3)
get_plane_6 = GetPlane(Numbers=robot_tcp_numbers_2, RobotSystem=robotsystem_parameter_3)
xy_plane = XYPlane(Origin=Point(0, 0, 0))
orient = Orient(Geometry=xy_plane, Source=get_plane_5, Target=get_plane_6)  # -> Geometry, Transform
probe_plane = Plane(get_plane_4)
orient_2 = Orient(Geometry=probe_plane, Source=PlaneXY(0, 0, 0), Target=orient.Geometry)  # -> Geometry, Transform
from_plane = FromPlane(Plane=orient_2.Geometry, RobotSystem=robotsystem_parameter_3)
panel_3 = Panel("""1000
1000
1000
1
1
1""")
multiplication_4 = Multiplication(A=from_plane, B=panel_3)

real_world_plane = Plane(orient_2.Geometry)
position_in_m = Number(from_plane)
position_in_mm = Number(multiplication_4)
position_from_robot = Panel(position_in_m)

construct_domain_3 = ConstructDomain(DomainStart=0, DomainEnd=loop_start.Counter)  # disabled
range_2 = Range(Domain=construct_domain_3, Steps=loop_start.Counter)  # disabled
merge_2 = Merge(Data1=list_item_3, Data2=list_item_2)  # disabled
list_item_4 = ListItem(List=renumber_paths, Index=range_2, Wrap=False)  # disabled
loft = Loft(Curves=merge_2, Options={Adjust=False, Closed=False, LoftEnds=0, LoftSimp=0, LoftType=0, Rebuild=10, Refit=0.01})  # disabled
surface_curve = SurfaceCurve(Surface=loft, Curve=list_item_4)  # -> Curves, flatten(Points), UVPoints, Normals, Parameters, Tangents; disabled

loop_end = LoopEnd(port=loop_start.port, Exit=False, Data=surface_curve.Curves, TimeOutVal=0, pausedState=False, state="Last & Record")  # disabled

custom_preview_2 = CustomPreview(Geometry=loop_end, Material=colour_swatch_2)  # disabled

point_right_plane_2 = Plane(point_right_plane)
origin_plane_2 = Plane(origin_plane)
point_down_plane_2 = Plane(point_down_plane)
xy_plane_2 = XYPlane(Origin=Point(0, 0, 0))

rectangle_3pt = Rectangle3Pt(PointA=origin_plane, PointB=point_right_plane, PointC=point_down_plane)  # -> Rectangle, Length
vector_2pt = Vector2Pt(PointA=origin_plane_2, PointB=point_right_plane_2, Unitize=False)  # -> Vector, Length
vector_2pt_2 = Vector2Pt(PointA=origin_plane_2, PointB=point_down_plane_2, Unitize=False)  # -> Vector, Length
centermark = Centermark(Plane=rectangle_3pt.Rectangle)  # -> Centermark, CenterPoint
reverse = Reverse(Vector=vector_2pt_2.Vector)
construct_plane_4 = ConstructPlane(Origin=centermark.CenterPoint, XAxis=vector_2pt.Vector, YAxis=reverse)
panel_4 = Panel(centermark.CenterPoint)
align_plane = AlignPlane(Plane=construct_plane_4, Direction=vector_2pt_2.Vector)  # -> Plane, Angle

symbol_simple = SymbolSimple(Style=6, Size=5, Rotation=0, Colour=RGB(255, 0, 200))
symbol_display = SymbolDisplay(Location=construct_plane_4, Display=symbol_simple)

align_planes_2 = AlignPlanes(Planes=align_plane.Plane, Master=xy_plane_2)
orient_target_plane = Plane(align_planes_2)

# ----
# Parameter Plotter
value_list_2 = ValueList({"Extrusion": 0, "Segment Distance": 1, "Layer Heigth": 2, "Joint Motion": 3}, selected="Joint Motion")
multiplication_5 = Multiplication(A=multiplication_2, B=clamp)
deconstruct_plane = DeconstructPlane(Plane=data_dam_2)  # -> Origin, XAxis, YAxis, ZAxis

# ----
# Orient to Location
# Comment: This Moves the Target Planes from the Base (0,0,0) Coordinate System to our Work Location.
z_shift = Slider(0, range=-15..80)
list_item_5 = ListItem(List=flatten(data_dam), Index=0, Wrap=True)
curve_middle = CurveMiddle(Curve=list_item_5)
unit_z_4 = UnitZ(Factor=expr("x*-1", z_shift))
xy_plane_3 = XYPlane(Origin=curve_middle)
move = Move(Geometry=xy_plane_3, Motion=unit_z_4)  # -> Geometry, Transform
toolpath_planes = Plane(data_dam_2)
image_sampler_2 = ImageSampler(Filter="Colour", Interpolate=False, Umax=1, Umin=0, Vmax=1, Vmin=0, Wrap=1)

# ---- group: Division
# Servo Parameters
average_tool_speed_mm_s = Slider(1.4, range=1..10)
division_2 = Division(SegmentDistance=multiplication_2, ToolSpeed=average_tool_speed_mm_s)  # -> flatten(Result)

average = Average(Input=division_2)
gain = Slider(300, range=200..1200)
lookahead_time = Slider(0.2, range=0.02..0.25)

division_3 = Division(A=average, B=0.008)
round = Round(Number=division_3)  # -> Nearest, Floor, Ceiling
multiplication_6 = Multiplication(A=round.Nearest, B=0.008)
merge_3 = Merge(Data1=graft(multiplication_6), Data2=graft(lookahead_time), Data3=graft(gain))
text_join_2 = TextJoin(Text=merge_3, Join=",")

# ----
# Print Head Tilt Settings
# Comment: Rotate the Target Planes along their Z-Axis
y_rotation_normal = Slider(0, range=-20..20)
image_sampler_3 = ImageSampler(Filter="Colour", Interpolate=False, Umax=1, Umin=0, Vmax=1, Vmin=0, Wrap=1)

# ----
# Create Targets
list_2 = FlagFields({"Shoulder": 1, "Elbow": 2, "Wrist": 4}, selected="Wrist")
list_3 = ValueList({"Joint", "Linear", "Process", "Servo"}, selected="Linear")
tool_parameter = ToolParameter(update_tool_2)

# ----
# Toolpath Positioning Optimization
move_in_x = Slider(0, range=-300..300)
z_axis_rotation = Slider(0, range=-180..180)
move_in_y = Slider(0, range=-300..300)
opossum = Opossum(
    OpossumData_OptimizationType=0,
    OpossumData_ResultSerializationStatus=0,
    OpossumData_objective=c_script,
    OpossumData_variable=[z_axis_rotation, move_in_x, move_in_y])

rotate_4 = Rotate(Geometry=orient_target_plane, Angle=degrees(z_axis_rotation), Plane=orient_target_plane)  # -> Geometry, Transform
vector_xyz = VectorXYZ(XComponent=move_in_x, YComponent=move_in_y, ZComponent=0)  # -> Vector, Length
move_2 = Move(Geometry=rotate_4.Geometry, Motion=vector_xyz.Vector)  # -> Geometry, Transform
orient_3 = Orient(Geometry=xy_plane_3, Source=xy_plane_3, Target=move_2.Geometry)  # -> Geometry, Transform
orient_4 = Orient(Geometry=toolpath_planes, Source=move.Geometry, Target=move_2.Geometry)  # -> Geometry, Transform
orient_5 = Orient(Geometry=data_dam, Source=move.Geometry, Target=move_2.Geometry)  # -> Geometry, Transform

rotate_plane_2 = RotatePlane(Plane=orient_4.Geometry, Angle=degrees(y_rotation_normal))
oriented_rotated_planes = Plane(rotate_plane_2)

planes = Plane(oriented_rotated_planes)
create_target_2 = CreateTarget(Plane=planes, RobConf=list_2, Motion=list_3, Tool=tool_parameter, IsCartesian=True)  # -> flatten(Target)

c_script = CSharpScript(robotSystem=robotsystem_parameter, targets=create_target_2, check_collision=Toggle(False))  # -> travelCost, jointPoses; inputs targets: list, check_collision: Boolean
# ---------- c_script: C# ----------
#r "C:\Users\pjvth\AppData\Roaming\Grasshopper\Libraries\Robots-movep-servoj\artifacts\bin\Robots.Grasshopper\release\Robots.dll"

using System;
using System.Collections.Generic;
using System.Reflection;
using Robots;
using Rhino.Geometry;

{
    const double ERROR_PENALTY = 1e9;

    bool doCollisionCheck = check_collision != null ? Convert.ToBoolean(check_collision) : false;

    double computedCost = ERROR_PENALTY;
    List<string> computedPoses = null;

    var robotSys = robotSystem as RobotSystem;
    if (robotSys == null) { }
    else if (targets == null || targets.Count == 0)
    {
        computedCost = 0.0;
    }
    else
    {
        double? buildplateZ = null;
        var firstRaw = targets[0];
        Target firstTarget = null;

        if (firstRaw is Target ft) firstTarget = ft;
        else
        {
            var vp = firstRaw.GetType().GetProperty("Value");
            if (vp != null) firstTarget = vp.GetValue(firstRaw) as Target;
        }

        if (firstTarget is CartesianTarget ct) buildplateZ = ct.Plane.Origin.Z + 46;

        if (buildplateZ != null)
        {
            double totalCost = 0.0;
            int jointCount = -1;
            double[] previousJoints = null;
            var poseList = new List<string>();
            bool hasPenalty = false;

            // ── MOVED OUTSIDE THE LOOP ──────────────────────────────────────
            double[] lastCheckedJoints = null;
            const double JOINT_CHANGE_THRESHOLD = 0.05; // radians (~2.9°)
            // ────────────────────────────────────────────────────────────────

            for (int i = 0; i < targets.Count; i++)
            {
                Target target = null;
                var raw = targets[i];

                if (raw is Target t) target = t;
                else
                {
                    var valueProp = raw.GetType().GetProperty("Value");
                    if (valueProp != null) target = valueProp.GetValue(raw) as Target;
                }

                if (target == null) { hasPenalty = true; break; }

                IEnumerable<double[]> hints = previousJoints != null ? new[] { previousJoints } : null;
                var targetList = new List<Target> { target };
                List<KinematicSolution> solutions = null;

                try { solutions = robotSys.Kinematics(targetList, hints); }
                catch { hasPenalty = true; break; }

                var solution = solutions[0];

                if (solution.Errors != null && solution.Errors.Count > 0)
                { hasPenalty = true; break; }

                if (i % 10 == 0 && solution.Planes != null && solution.Planes.Length >= 7)
                {
                    bool belowBuildplate = false;
                    for (int p = 3; p <= 6; p++)
                    {
                        if (solution.Planes[p].Origin.Z < buildplateZ.Value)
                        { belowBuildplate = true; break; }
                    }
                    if (belowBuildplate) { hasPenalty = true; break; }
                }

                double[] currentJoints = solution.Joints;
                if (jointCount < 0) jointCount = currentJoints.Length;

                // SELF-COLLISION CHECK
                if (i % 25 == 0 && doCollisionCheck)   // ← stride increased to 25
                {
                    bool shouldCheck = lastCheckedJoints == null;
                    if (!shouldCheck)
                    {
                        // Lower arm (mesh3) is driven by joints 0-2
                        // Wrist (mesh5-7) is driven by joints 3-5
                        // A collision between them requires BOTH sides to have moved
                        bool lowerArmMoved = false;
                        bool wristMoved = false;

                        for (int j = 0; j < 3; j++)
                            if (Math.Abs(currentJoints[j] - lastCheckedJoints[j]) > JOINT_CHANGE_THRESHOLD)
                            { lowerArmMoved = true; break; }

                        for (int j = 3; j < currentJoints.Length; j++)
                            if (Math.Abs(currentJoints[j] - lastCheckedJoints[j]) > JOINT_CHANGE_THRESHOLD)
                            { wristMoved = true; break; }

                        shouldCheck = lowerArmMoved && wristMoved; // both sides must move to change proximity
                    }

                    if (shouldCheck)
                    {
                        lastCheckedJoints = currentJoints;

                        var posedMeshes = RhinoMeshPoser.Pose(robotSys, solutions, targetList);

                        if (posedMeshes != null && posedMeshes.Count >= 8)
                        {
                            Mesh mesh3 = posedMeshes[3];
                            Mesh mesh5 = posedMeshes[5];
                            Mesh mesh6 = posedMeshes[6];
                            Mesh mesh7 = posedMeshes[7];

                            var pairsA = new Mesh[] { mesh3, mesh3, mesh3 };
                            var pairsB = new Mesh[] { mesh5, mesh6, mesh7 };

                            bool meshCollision = false;

                            for (int a = 0; a < pairsA.Length; a++)
                            {
                                if (pairsA[a] == null || pairsB[a] == null) continue;

                                // Fast bounding-box pre-filter ─────────────────────────
                                var boxA = pairsA[a].GetBoundingBox(false);
                                var boxB = pairsB[a].GetBoundingBox(false);
                                boxA.Inflate(1.0); // 1 mm tolerance
                                if (!boxA.Contains(boxB.Min) &&
                                    !boxA.Contains(boxB.Max) &&
                                    !boxB.Contains(boxA.Min) &&
                                    !boxB.Contains(boxA.Max))
                                    continue; // boxes don't overlap — skip MeshClash
                                // ──────────────────────────────────────────────────────

                                var clashes = Rhino.Geometry.Intersect.MeshClash.Search(
                                    new[] { pairsA[a] }, new[] { pairsB[a] }, 0.0, 1);

                                if (clashes != null && clashes.Length > 0)
                                { meshCollision = true; break; }
                            }

                            foreach (var pm in posedMeshes)
                                if (pm != null) pm.Dispose();

                            if (meshCollision) { hasPenalty = true; break; }
                        }
                    }
                }

                poseList.Add(string.Join(",", System.Array.ConvertAll(currentJoints, j => j.ToString("G7"))));

                if (previousJoints != null)
                {
                    for (int j = 0; j < jointCount; j++)
                        totalCost += Math.Abs(currentJoints[j] - previousJoints[j]);
                }

                previousJoints = currentJoints;
            }

            computedCost  = hasPenalty ? ERROR_PENALTY : totalCost;
            computedPoses = poseList;
        }
    }

    travelCost = computedCost;
    jointPoses = computedPoses;
}
# ---------- end c_script ----------
panel_5 = Panel(c_script.travelCost)
data_dam_3 = DataDam(DataDataA=c_script.jointPoses, BufferDelay=10000000, BufferMode=0)

list_4 = ValueList({"Joint", "Linear", "Process", "Servo"}, selected="Servo")
list_5 = ValueList({"Joint", "Linear", "Process", "Servo"}, selected="Linear")
joints_parameter = JointsParameter(data_dam_3)
tool_parameter_2 = ToolParameter(tool_parameter)
servo_parameters = ServoParameters(text_join_2)
list_item_6 = ListItem(List=flatten(create_target_2), Index=0, Wrap=True)
create_target_3 = CreateTarget(Joints=joints_parameter, Motion=list_4, Tool=tool_parameter_2, Servo=servo_parameters, IsCartesian=False)
create_target_4 = CreateTarget(Joints=joints_parameter, Motion=list_5, Tool=tool_parameter_2, IsCartesian=False)
merge_4 = Merge(Data1=flatten(list_item_6), Data2=flatten(create_target_3))

# ----
# Calculate Joint Speeds and Accelerations
# System Limits UR5: Max joint speed is 3.14 rad/s.
# 
# Max joint acceleration is 14 rad/s^2.
text_split = TextSplit(Text=data_dam_3, Separators=",")  # -> simplify(Result)
relative_item = RelativeItem(Tree=text_split, Offset="{1}", WrapPaths=False, WrapItems=False)  # -> ItemA, ItemB
subtraction_3 = Subtraction(A=relative_item.ItemA, B=relative_item.ItemB)
value_list_3 = ValueList({"Joint Displacement": 0, "Joint Speeds": 1, "Joint Accelerations": 2}, selected="Joint Displacement")
bounds_2 = Bounds(Numbers=flatten(subtraction_3))
division_4 = Division(JointDisplacement=subtraction_3, Time=multiplication_6)
bounds_3 = Bounds(Numbers=flatten(division_4))
relative_item_2 = RelativeItem(Tree=division_4, Offset="{1}", WrapPaths=False, WrapItems=False)  # -> ItemA, ItemB
min_max_displacement = Panel(bounds_2)
subtraction_4 = Subtraction(A=relative_item_2.ItemA, B=relative_item_2.ItemB)
min_max_speed = Panel(bounds_3)
division_5 = Division(JointSpeedDifference=subtraction_4, Time=multiplication_6)
stream_filter_4 = StreamFilter(Gate=value_list_3, Stream0=subtraction_3, Stream1=division_4, Stream2=division_5)
square = Square(Value=stream_filter_4)
mass_addition = MassAddition(Input=square)  # -> Result, PartialResults
square_root = SquareRoot(Value=mass_addition.Result)
average_2 = Average(Input=flatten(square_root))
bounds_4 = Bounds(Numbers=flatten(division_5))
expression_2 = Expression(x=flatten(square_root), y=average_2, Expression="(x - y)^2")
mass_addition_2 = MassAddition(Input=expression_2)  # -> Result, PartialResults
list_length_3 = ListLength(List=expression_2)
average_cummulative_joint_speed = Panel(average_2)
division_6 = Division(A=mass_addition_2.Result, B=list_length_3)
min_max_acceleration = Panel(bounds_4)
joint_speed_variance = Panel(division_6)

stream_filter_5 = StreamFilter(Gate=value_list_2, Stream0=multiplication_5, Stream1=multiplication_2, Stream2=clamp, Stream3=square_root)  # -> flatten(Stream)
bounds_5 = Bounds(Numbers=stream_filter_5)
deconstruct_domain_2 = DeconstructDomain(Domain=bounds_5)  # -> Start, End
gradient = Gradient(
    LowerLimit=deconstruct_domain_2.Start,
    UpperLimit=deconstruct_domain_2.End,
    Parameter=stream_filter_5,
    stops=[0: RGB(48, 18, 59), 0.0294: RGB(56, 40, 112), 0.0588: RGB(63, 62, 156), 0.0882: RGB(68, 82, 193), 0.118: RGB(70, 102, 221), 0.147: RGB(71, 122, 241)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])
custom_preview_3 = CustomPreview(Geometry=flatten(deconstruct_plane.Origin), Material=gradient)

highest_joint_displacement = Panel(deconstruct_domain_2.End)

# ----
# Merge Targets
toolpath_targets = TargetParameter(merge_4)
start_joint_target = TargetParameter(create_target)
merge_5 = Merge(Data1=start_joint_target, Data2=toolpath_targets, Data3=start_joint_target)
program_targets = TargetParameter(merge_5)

# ----
# Upload 3D-printing Program
# Comment: When this button is clicked the grasshopper script freezes. In the background the script is running and the laptop listens to the robot now. Start the robot program on the robot and the 3D-printing process will start.
list_length_4 = ListLength(List=flatten(deconstruct_plane.Origin))
tree_statistics_2 = TreeStatistics(Tree=planes)  # -> Paths, Length, Count
multiplication_7 = Multiplication(A=multiplication_6, B=list_length_4)
list_item_7 = ListItem(List=tree_statistics_2.Length, Index=0, Wrap=True)
panel_6 = Panel("C:\Users\pjvth\High-tech Engineering\Thesis\Grasshopper control\Grasshopper python scripts\GH_program_3Dprinting.script")
construct_smooth_time = ConstructSmoothTime(Days=0, Hours=0, Minutes=0, Seconds=multiplication_7)
list_item_8 = ListItem(List=data_dam_3, Index=expr("x-1", list_item_7), Wrap=True)
python_3_script_2 = Python3Script(
    T=multiplication_6,
    PPL=flatten(tree_statistics_2.Length),
    LT=lookahead_time,
    G=gain,
    M=list_item_8,
    P=data_dam_3,
    H=flatten(clamp),
    D=flatten(multiplication_2),
    filepath=panel_6,
    export=Button(),
    ROBOT_IP=robot_ip_txt,
    REMOTE_NAME="GH_3Dprinting.script")  # inputs T: list of String, PPL: list of String, LT: String, G: String, M: list of String, P: list, H: list, D: list, filepath: String, export: Boolean, REMOTE_NAME: String
# ---------- python_3_script_2: Python ----------
import Grasshopper as gh
import paramiko
import socket
import json
import os

# ==================== CONFIGURATIE ====================
# Het vaste pad waar de standalone communicator in VS Code naar luistert
JSON_EXPORT_PATH = r"C:\Users\pjvth\High-tech Engineering\Thesis\Grasshopper control\Grasshopper python scripts\Grasshopper script components\print_data.json"
# ======================================================

def export_json_data(waypoints, heights, distances, export_path):
    """Exporteert de ruwe data naar een JSON-bestand voor VS Code."""
    print("Bezig met exporteren van trajectdata naar JSON...")
    data = {
        "P": [str(item) for item in waypoints],
        "H": [str(item) for item in heights],
        "D": [str(item) for item in distances]
    }
    
    try:
        # Zorg dat de map bestaat
        target_dir = os.path.dirname(export_path)
        if not os.path.exists(target_dir):
            os.makedirs(target_dir)
            
        with open(export_path, 'w') as f:
            json.dump(data, f, indent=4)
        print(f"✓ Data succesvol geëxporteerd naar JSON: {export_path}")
        return True
    except Exception as e:
        print(f"[ERROR] Fout bij exporteren van JSON: {e}")
        return False


def upload_program_to_robot(robot_ip, local_file_path, remote_filename):
    """Uploadt het gegenereerde URScript via SFTP naar de robot."""
    username = "root"
    password = "easybot" # Standaard voor CB3
    port = 22

    print(f"Verbinden met robot via SSH ({robot_ip})...")

    try:
        ssh = paramiko.SSHClient()
        ssh.set_missing_host_key_policy(paramiko.AutoAddPolicy())
        ssh.connect(robot_ip, port, username, password)

        sftp = ssh.open_sftp()
        remote_path = f"/programs/{remote_filename}"
        
        print(f"Uploading {local_file_path} naar {remote_path}...")
        sftp.put(local_file_path, remote_path)
        print("✓ URScript succesvol geüpload naar de robot!")

        sftp.close()
        ssh.close()
        return True
    except Exception as e:
        print(f"[ERROR] Er is een fout opgetreden bij de upload: {e}")
        return False


def assemble_program(PPL, G, T, LT, M):
    """Assembleert de URScript code string."""
    # 1. Header met Setup (Verwijst naar de laptop proxy op poort 2323)
    header = """def extrusion_program():
    socket_open("172.19.126.244", 3000, "laptop_socket")
    sleep(2)
    socket_open("172.19.126.244", 2323, "duet_socket")
    sleep(2)
    set_tcp(p[0, -0.08034, 0.12552, 0, 1.5708, 0])
    set_payload(0.32, [-0.038, -0.001, 0.041])
    """

    # 2. Globale variabelen vanuit Grasshopper
    ppl_str =       "    global poses_per_layer = [" + ", ".join([str(x) for x in PPL]) + "]"
    time_str =      "    global time = " + "".join([str(x) for x in T])
    lt_str =        "    global lt = " + "".join([str(x) for x in LT])
    gain_str =      "    global g = " + "".join([str(x) for x in G])
    midpoint_str =  "    global levelpoint = [" + ", ".join([str(x) for x in M]) + "]"
    
    # 3. Logica en Loops
    footer = """
    global extrusion_trigger = False
    global thread_val_E = 0
    global thread_val_F = 0 
    global target_pose = [0,0,0,0,0,0]
    global raw_data = [0,0,0,0,0,0,0,0,0]
    global rest_pose = [1.57, -1.57, 1.57, 0, 1.57, 3.14]

    def fetch_next_pose():
        socket_send_string("NEXT", "laptop_socket")
        data = socket_read_ascii_float(8, "laptop_socket")
        textmsg("laptop data = ",data)
        return data
    end

    raw_data = fetch_next_pose()
    if raw_data[0] < 8:
        popup("Error: Could not fetch initial waypoint", "Error", error=True)
        halt
    end

    target_pose = [raw_data[1], raw_data[2], raw_data[3], raw_data[4], raw_data[5], raw_data[6]]

    thread ExtruderControl():
        while True:
            if extrusion_trigger == True:
                gcode_line = str_cat("G1 E", str_cat(thread_val_E, str_cat(" F", thread_val_F)))
                socket_send_line(gcode_line, "duet_socket")
                extrusion_trigger = False
                textmsg(gcode_line, " sent")
            end
            sync()
        end
    end

    ext_thread_handle = run ExtruderControl()

    # Bed levelling
    movel(target_pose, a=1.0, v=0.1)
    popup("Use nozzle as reference to level printbed and press CONTINUE to move on to the next corner.", "Level printbed", blocking=True)
    movel(levelpoint, a=1.0, v=0.1)
    popup("Use nozzle as reference to level printbed and press CONTINUE to move on to the next corner.", "Level printbed", blocking=True)
    movel(target_pose, a=1.0, v=0.1)
    popup("Use nozzle as reference to level printbed and press CONTINUE to move on to the next corner.", "Level printbed", blocking=True)
    movel(levelpoint, a=1.0, v=0.1)
    popup("Use nozzle as reference to level printbed and press CONTINUE to move on to the next corner.", "Level printbed", blocking=True)

    # Heating
    movej(rest_pose, a=1, v=0.3, r=0)
    socket_send_line("M104 S200", "duet_socket")
    socket_send_line("M190 S65", "duet_socket")
    socket_send_line("G1 E30 F300", "duet_socket")
    
    layer_idx = 0
    pose_pointer = 0
    num_layers = length(poses_per_layer)

    popup("If Nozzle is primed press CONTINUE to move to the start position", "Start", blocking=True)
    movej(target_pose, a=1.0, v=0.1)

    keep_printing = True
    
    while keep_printing:
        while layer_idx < num_layers:
            poses_in_this_layer = poses_per_layer[layer_idx]
            i = 0

            if (layer_idx == 2):
                socket_send_line("M106 S255", "duet_socket")
            end

            while i < poses_in_this_layer:
                raw_data = fetch_next_pose()
                if raw_data[0] >= 6:
                    target_pose = [raw_data[1], raw_data[2], raw_data[3], raw_data[4], raw_data[5], raw_data[6]]
                    
                    dist = raw_data[8]

                    if layer_idx == 0:
                        h = raw_data[7]*1.1
                    else:
                        h = raw_data[7]
                    end

                    thread_val_E = (((0.4 * h) - (0.215*pow(h,2)))* dist)/2.405
                    thread_val_F = (thread_val_E / time) * 60
                    extrusion_trigger = True

                    servoj(target_pose, t=time, lookahead_time=lt, gain=g)

                else:
                    textmsg("Warning: Failed to receive pose at pointer ", pose_pointer)
                    keep_printing = False
                    sync()
                end

                pose_pointer = pose_pointer + 1
                i = i + 1
                
            end
            layer_idx = layer_idx + 1
        end 
        
    end

    kill ext_thread_handle 
    socket_send_line("M104 S0", "duet_socket")
    socket_send_line("M140 S0", "duet_socket")
    socket_send_line("M107", "duet_socket")

    movej(rest_pose, a=1, v=0.3, r=0)
    textmsg("Program finished and thread killed -> turn off heaters.")
    socket_close("duet_socket")
end
extrusion_program()
    """

    # Samenvoegen tot één script string
    full_script = (header + "\n" + ppl_str + "\n" + gain_str + "\n" + 
                   lt_str + "\n" + time_str + "\n" + midpoint_str + "\n" + footer)
    return full_script


# --- Hoofdprogramma Uitvoering ---
if export == True:
    print("=== START INTEGRATED EXPORT SEQUENCE ===")
    
    # Stap 1: Exporteer de trajectdata naar het JSON-bestand voor VS Code
    json_success = export_json_data(P, H, D, JSON_EXPORT_PATH)
    
    if json_success:
        # Stap 2: Compileer het URScript en schrijf het lokaal weg
        try:
            script_code = assemble_program(PPL, G, T, LT, M)
            with open(filepath, 'w') as f:
                f.write(script_code)
            print(f"✓ URScript tijdelijk lokaal opgeslagen op: {filepath}")
            
            # Stap 3: Upload het `.script` bestand naar de robot via SFTP
            upload_program_to_robot(ROBOT_IP, filepath, REMOTE_NAME)
            
        except Exception as e:
            print(f"[ERROR] Fout tijdens het compileren/schrijven van het URScript: {e}")
            
    print("=== EXPORT SEQUENCE AFGEROND ===")
# ---------- end python_3_script_2 ----------
duration = Panel(construct_smooth_time)

# ----
# Simulate Program
merge_6 = Merge(Data1=start_joint_target, Data2=create_target_4)  # -> flatten(Result)
unit_z_5 = UnitZ(Factor=Slider(0, range=-100..10))
simulation_time = Slider(0, range=0..1)
move_3 = Move(Geometry=align_planes_2, Motion=unit_z_5)  # -> Geometry, Transform
plane_surface = PlaneSurface(Plane=move_3.Geometry, XSize=Domain(-10, 10), YSize=Domain(-10, 10))

# ----
# Create Program
panel_7 = Panel("popup(\"press CONTINUE to start the program\", \"StartConfirmation\",warning=False, error=False, blocking=True)")
data_dam_4 = DataDam(DataDataA=program_targets, BufferDelay=10000000, BufferMode=0)
programname = Panel("Lshape_tuned")
custom_command = CustomCommand(Name="CustomCommand", Manufacturer="UR", Code=panel_7)
robotsystem_parameter_4 = RobotSystemParameter(robotsystem_parameter)
command_parameter = CommandParameter(custom_command)
target_parameter = TargetParameter(flatten(data_dam_4))

# ----
# Upload Motion Program
use_ftp_upload = BooleanToggle(True)
ftp_prefix = Panel("sftp://")
robot_ip_txt_3 = Text(robot_ip_txt)
concatenate = Concatenate(Fragment_A=ftp_prefix, Fragment_C=robot_ip_txt_3)
boolean = Boolean(use_ftp_upload)
upload = Button()
stream_filter_6 = StreamFilter(Gate=boolean, Stream0=robot_ip_txt_3, Stream1=concatenate)
gate_or = GateOr(B=upload)
robotip_txt = Text(stream_filter_6)
boolean_2 = Boolean(gate_or)

get_current_time = GetCurrentTime(get_time=boolean_2)  # -> out, time_string; inputs get_time: Boolean
# ---------- get_current_time: Python ----------
"""Provides a scripting component.
    Inputs:
       
    Output:
        a: The a output variable"""

__author__ = "robin godwyll"

import rhinoscriptsyntax as rs
from datetime import datetime 

def give_time(): 
    time = datetime.now()
    time_string = time.strftime("%m%d%H%M")
    return time_string
    
if get_time: 
    time_string = give_time()
# ---------- end get_current_time ----------
concatenate_2 = Concatenate(Fragment_A=programname, A=get_current_time.time_string)
create_program = CreateProgram(
    Name=concatenate_2,
    RobotSystem=robotsystem_parameter_4,
    Targets=target_parameter,
    InitCommands=command_parameter,
    StepSize=Slider(0.5, range=0..10))  # -> Program, Code, Duration, Warnings, Errors
program_parameter = ProgramParameter(create_program.Program)
program_duration = Number(create_program.Duration)
program_code = Text(create_program.Code)
warnings = Text(create_program.Warnings)
errors = Text(create_program.Errors)

create_program_2 = CreateProgram(Name=concatenate_2, RobotSystem=robotsystem_parameter, Targets=merge_6, StepSize=1)  # -> Program, Code, Duration, Warnings, Errors
panel_8 = Panel(create_program_2.Errors)
panel_9 = Panel(create_program_2.Warnings)
program_simulation = ProgramSimulation(Program=create_program_2.Program, Time=simulation_time, Normalized=True)  # -> SystemMeshes, JointRotations, Plane, Index, Time, Program, Errors
list_length_5 = ListLength(List=program_simulation.SystemMeshes)  # -> expr("x-1", Length)
range_3 = Range(Domain=list_length_5, Steps=7)
check_collisions = CheckCollisions(
    Program=create_program_2.Program,
    FirstSet=range_3,
    SecondSet=8,
    Environment=plane_surface,
    EnvironmentPlane=-1,
    LinearStepSize=100,
    AngularStepSize=0.7853981634)  # -> CollisionFound, TargetIndex, CollidedMeshes
panel_10 = Panel(check_collisions.TargetIndex)
mesh = Mesh(check_collisions.CollidedMeshes)
panel_11 = Panel(check_collisions.CollisionFound)

# ---- group: Robot Program Output
errors_2 = Text(errors)
code = Text(program_code)
warnings_2 = Text(warnings)
program_parameter_2 = ProgramParameter(program_parameter)

program_code_2 = Panel(code)
errors_3 = Panel(errors_2)
program = Panel(program_parameter_2)
warnings_3 = Panel(warnings_2)

# ----
program_parameter_3 = ProgramParameter(program_parameter)
remote_connection = RemoteConnection(Program=program_parameter_3, IP=robotip_txt, Upload=boolean_2, Play=False, Pause=False)
connection_log_txt = Text(remote_connection)
panel_12 = Panel(connection_log_txt)
