# Grasshopper definition servoj_ghScript elevation.gh (Grasshopper 1.0.8)
# plug-ins: Robots, RobotsExtended, treesloth01, Anemone

construct_domain = ConstructDomain(DomainStart=0, DomainEnd=1)

# ----
# Send to Robot
choose_a_robot = ValueList({"Robotarm": 0, "Robotarm 2": 1}, selected="Robotarm")
robotarm_ip_address = Panel("172.19.126.241")
robotarm_2_ip_address = Panel("172.19.126.245")
stream_filter = StreamFilter(Gate=choose_a_robot, Stream0=robotarm_ip_address, Stream1=robotarm_2_ip_address)
robot_ip_txt = Text(stream_filter)

# ----
# Load Robot
list = RobotsLibrary({"UR3e", "UR5e", "UR10e", "UR16e", "UR3", "UR5", "UR10", "UR20", "UR30"}, selected="UR5", Type=0)
load_robot_system = LoadRobotSystem(Name=list, Base=PlaneXY(0, 0, 0))
robotsystem_parameter = RobotSystemParameter(load_robot_system)

# ---- group: Get Data From RObot
get_robot_position = Button()
robot_ip_txt_2 = Text(robot_ip_txt)
get_robot_position_2 = Script(run=get_robot_position, ip_address=robot_ip_txt_2)  # -> out, tcp, tool; inputs run: Boolean, ip_address: String
# ---------- get_robot_position_2: Python ----------
import socket
import struct
import math
from datetime import datetime

def connect_to_ur_robot(host, port=30002):
    try:
        s = socket.create_connection((host, port), timeout=1.0)
        print(f"Connected to UR robot at {host}:{port}")
        return s
    except Exception as e:
        now = datetime.now()
        print(f"{now:%Y-%m-%d/%H:%M:%S}: Failed to connect to UR robot: {e}")
        return None

def parse_info(data):
    """Parses Cartesian info and tool offsets from the robot's data."""
    try:
        header_size = 5
        if len(data) > header_size:
            size, ptype = struct.unpack("!iB", data[:header_size])
            print(ptype, size)
            if ptype == 16: 
                print("Received Robot State Message" , size)
                data = data[header_size:]
                while data: 
                    print("Subpackage", "remaining data:", len(data))
                    size, ptype = struct.unpack("!iB", data[:header_size])
                    print("Subpackage type: ", ptype, size)
                    if ptype == 4: # Cartesian Information
                        format_str = "!dddddddddddd"
                        unpacked = struct.unpack(format_str, data[header_size:header_size + struct.calcsize(format_str)])
                        print(unpacked)
                        cartesian_info = {
                            "X": unpacked[0], "Y": unpacked[1], "Z": unpacked[2],
                            "Rx": unpacked[3], "Ry": unpacked[4], "Rz": unpacked[5],
                            "tcpOffsetX": unpacked[6], "tcpOffsetY": unpacked[7], "tcpOffsetZ": unpacked[8],
                            "tcpOffsetRx": unpacked[9], "tcpOffsetRy": unpacked[10], "tcpOffsetRz": unpacked[11]
                        }
                        print(cartesian_info)

                        return (unpacked[:6], unpacked[6:])
                    elif ptype == 1:
                        """print(size)
                        format_str = "!dddddddddddd"
                        unpacked = struct.unpack(format_str, data[header_size:header_size + struct.calcsize(format_str)])
                        print(unpacked)
                        print("sdfs")
                        joint_info = {
                            "J0": math.degrees(unpacked[0]), "J1": math.degrees(unpacked[1]), "J2": math.degrees(unpacked[2]),
                            "J3": math.degrees(unpacked[3]), "J4": math.degrees(unpacked[4]), "J5": math.degrees(unpacked[5]),
                            "AJ0": math.degrees(unpacked[6]), "AJ1": math.degrees(unpacked[7]), "AJ2": math.degrees(unpacked[8]),
                            "AJ3": math.degrees(unpacked[9]), "AJ4": math.degrees(unpacked[10]), "AJ5": math.degrees(unpacked[11])
                        }
                        print(joint_info)
                        print("SSSSS"*20)
                        format_str = "!dddffffB dddffffB dddffffB dddffffB dddffffB dddffffB"
                        unpacked = struct.unpack(format_str, data[header_size:header_size + struct.calcsize(format_str)])
                        print(unpacked)
                        joint_info = {
                            "J0": math.degrees(unpacked[0]), "J1": math.degrees(unpacked[1]), "J2": math.degrees(unpacked[2]),
                            "J3": math.degrees(unpacked[3]), "J4": math.degrees(unpacked[4]), "J5": math.degrees(unpacked[5]),
                            "AJ0": math.degrees(unpacked[6]), "AJ1": math.degrees(unpacked[7]), "AJ2": math.degrees(unpacked[8]),
                            "AJ3": math.degrees(unpacked[9]), "AJ4": math.degrees(unpacked[10]), "AJ5": math.degrees(unpacked[11])
                        }
                        print(joint_info)
                        exit()"""
                        pass
                    data = data[size : ]

    except Exception as e:
        print(f"Error parsing Cartesian info: {e}")
    return None

def get_tcp_and_tool_offsets(robot_socket):
    """Requests and retrieves TCP position and tool offsets from the robot."""
    try:
        #while True:
        for i in range(5):
            data = robot_socket.recv(4096)
            if not data:
                break

            cartesian_info = parse_info(data)
            if cartesian_info:
                tcp_position, tool_config = cartesian_info
                print(f"TCP Position: {tcp_position}")
                print(f"Tool Offsets: {tool_config}")
                return tcp_position, tool_config
                break
            else:
                print("No Cartesian info found in the data")
        
        # if none found
        return None, None

    except Exception as e:
        print(f"Error retrieving data from the robot: {e}")

def connect_and_get(IP):
    host = IP  # Replace with your robot's IP address
    robot_socket = connect_to_ur_robot(host)

    if robot_socket:
        tcp , tool = get_tcp_and_tool_offsets(robot_socket)
        robot_socket.close()
        return tcp, tool


tcp, tool = connect_and_get(ip_address)
tcp = [x for x in tcp]
tool = [x for x in tool]
# ---------- end get_robot_position_2 ----------
robot_tcp_numbers = Number(get_robot_position_2.tcp)
tool_tcp_numbers = Number(get_robot_position_2.tool)

# ----
# Creating the Tool
brep = Brep(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)
brep_2 = Brep(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)
unit_x = UnitX(Factor=1)
solid_union = SolidUnion(Breps=[brep, brep_2])
unit_z = UnitZ(Factor=expr("x*-1", 1))
mesh_brep = MeshBrep(
    Brep=solid_union,
    Settings={GridMaxCount=0, GridMinCount=16, JaggedSeams=False, MaxEdgeLength=0, MinEdgeLength=0.0001, MinTolerance=0, Refine=True, RefineAngle=0, RelativeTolerance=0.65, SimplePlanes=True, Tolerance=0})
point = Point(Point(0, 0, 196.7699975))
volume = Volume(Geometry=mesh_brep)  # -> Volume, Centroid
construct_plane = ConstructPlane(Origin=point, XAxis=unit_x, YAxis=unit_z)
create_tool = CreateTool(Name="UR5_Thermoplastic_Extruder_02", TCP=construct_plane, Weight="0.72", Centroid=volume.Centroid, Mesh=mesh_brep)  # -> Tool, TCP
update_tool = UpdateTool(GH_Tool=create_tool.Tool, TCP=create_tool.TCP, IsCtrl=False)

# ----
# Set Start Pose
# Comment: Set the Joint angles of the robot at the start of the Program.
joint_2_shoulder = Slider(-1.57, range=-6.28..6)
joint_1_base = Slider(1.57, range=0..6)
joint_3_elbow = Slider(1.57, range=0..6)
joint_4_wrist_1 = Slider(-1.57, range=-3.14..3.14)
joint_5_wrist_2 = Slider(-1.57, range=-3.14..3.14)
joint_6_wrist_3 = Slider(0, range=0..6)
merge = Merge(
    Data1=joint_1_base,
    Data2=joint_2_shoulder,
    Data3=joint_3_elbow,
    Data4=joint_4_wrist_1,
    Data5=joint_5_wrist_2,
    Data6=joint_6_wrist_3)
text_join = TextJoin(Text=merge, Join=",")
create_target = CreateTarget(Joints=text_join, IsCartesian=False)
start_joint_target = TargetParameter(create_target)

# ----
# Import Model Waypoints
number_slider = Slider(6, range=1..10)
panel = Panel("C:\Users\pjvth\High-tech Engineering\Thesis\Non-Planar Models\ISM_toolpath.txt")
xz_plane = XZPlane(Origin=Point(0, 0, 0))
elevation = Slider(22, range=0..50)
number_slider_2 = Slider(1, range=0.1..5)
python_3_script = Python3Script(filepath=panel, elevation=elevation)  # -> a; inputs filepath: String
# ---------- python_3_script: Python ----------
import math
import Rhino.Geometry as rg

def parse_layers_from_txt(filepath):
    model = []
    with open(filepath, 'r') as file:
        lines = file.readlines()

    current_layer = []

    for line in lines:
        line = line.strip()
        if not line:
            continue

        if line.startswith("Nodes on the"):
            if current_layer:
                model.append(current_layer)
                current_layer = []
        else:
            try:
                x_str, z_str = line.split(',')
                point = [float(x_str.strip()), 0.0, float(z_str.strip()) + elevation]

                if len(current_layer) == 0:
                    current_layer.append(point)
                else:
                    dx = point[0] - current_layer[-1][0]
                    dz = point[2] - current_layer[-1][2]
                    dis = math.sqrt(dx*dx + dz*dz)

                    if dis > 0.5:
                        current_layer.append(point)

            except ValueError:
                pass

    if current_layer:
        model.append(current_layer)

    return model

model = []
j = 0
y_base = 0.3 * j

while y_base <= elevation:
    layer = [[120, y_base], [150, y_base]]
    model.append(layer)
    j += 1
    y_base = 0.3*j
# -----------------------------
# MAIN
# -----------------------------

layers = parse_layers_from_txt(filepath)

polylines = []

for layer in layers:
    pts = []
    for p in layer:
        pts.append(rg.Point3d(p[0], p[1], p[2]))

    if len(pts) > 1:
        polylines.append(rg.Polyline(pts))
    
a = polylines

print(a)
# ---------- end python_3_script ----------
unit_y = UnitY(Factor=Slider(0.5, range=0..1))
curve = Curve(python_3_script)
move_to_plane = MoveToPlane(Geometry=curve, Plane=xz_plane, Above=True, Below=True)  # -> Geometry, Transform
linear_array = LinearArray(Geometry=move_to_plane.Geometry, Direction=unit_y, Count=number_slider)  # -> Geometry, Transform
multiplication = Multiplication(A=elevation, B=number_slider_2)
scale = Scale(Geometry=linear_array.Geometry, Center=Point(0, 0, 0), Factor=number_slider_2)  # -> flatten(Geometry), Transform
shift_list = ShiftList(List=scale.Geometry, Shift=1, Wrap=False)
tween_curve = TweenCurve(CurveA=scale.Geometry, CurveB=shift_list, Factor=0.4, BlendType=0)
tween_curve_2 = TweenCurve(CurveA=scale.Geometry, CurveB=shift_list, Factor=0.8, BlendType=0)
tween_curve_3 = TweenCurve(CurveA=scale.Geometry, CurveB=shift_list, Factor=0.2, BlendType=0)
tween_curve_4 = TweenCurve(CurveA=scale.Geometry, CurveB=shift_list, Factor=0.6, BlendType=0)
weave = Weave(
    Pattern=[0, 1, 2, 3, 4],
    Stream0=scale.Geometry,
    Stream1=tween_curve_3,
    Stream2=tween_curve,
    Stream3=tween_curve_4,
    Stream4=tween_curve_2,
    NullGaps=False)
yz_plane = YZPlane(Origin=Point(0, 0, 0))

stream_filter_2 = StreamFilter(Gate=0, Stream0=scale.Geometry, Stream1=weave)

# ----
# Evelation for Collision Prevention
end_points = EndPoints(Curve=move_to_plane.Geometry)  # -> Start, End
polyline = PolyLine(Vertices=end_points.Start, Closed=False)
xy_plane = XYPlane(Origin=Point(0, 0, 0))
polyline_2 = PolyLine(Vertices=end_points.End, Closed=False)
extremes = Extremes(Curve=polyline_2, Plane=xy_plane)  # -> Highest, Lowest
extremes_2 = Extremes(Curve=polyline, Plane=xy_plane)  # -> Highest, Lowest
project_point = ProjectPoint(Point=extremes.Lowest, Direction=Vector(0, 0, -1), Geometry=xy_plane)  # -> Point, Index
project_point_2 = ProjectPoint(Point=extremes_2.Lowest, Direction=Vector(0, 0, -1), Geometry=xy_plane)  # -> Point, Index
merge_2 = Merge(Data1=extremes_2.Lowest, Data2=project_point_2.Point)
merge_3 = Merge(Data1=project_point.Point, Data2=extremes.Lowest)
division = Division(Elevation=multiplication, LayerHeight="0.2")
polyline_3 = PolyLine(Vertices=merge_2, Closed=False)
polyline_4 = PolyLine(Vertices=merge_3, Closed=False)
divide_curve = DivideCurve(Curve=polyline_3, Count=division, Kinks=False)  # -> reverse(Points), Tangents, Parameters
divide_curve_2 = DivideCurve(Curve=polyline_4, Count=division, Kinks=False)  # -> Points, Tangents, Parameters
cull_index = CullIndex(List=divide_curve_2.Points, Indices=-1, Wrap=True)
cull_index_2 = CullIndex(List=divide_curve.Points, Indices=-1, Wrap=True)
weave_2 = Weave(Pattern=[1, 0, 0, 1], Stream0=graft(cull_index_2), Stream1=graft(cull_index), NullGaps=False)  # -> reverse(Weave)
polyline_5 = PolyLine(Vertices=weave_2, Closed=False)  # -> reverse(Polyline)

linear_array_2 = LinearArray(Geometry=polyline_5, Direction=unit_y, Count=number_slider)  # -> flatten(Geometry), Transform

length = Length(Curve=linear_array_2.Geometry)
division_2 = Division(A=length, B=5)
divide_curve_3 = DivideCurve(Curve=linear_array_2.Geometry, Count=division_2, Kinks=False)  # -> simplify(Points), simplify(Tangents), Parameters

# ----
# Layer Heigth
tree_statistics = TreeStatistics(Tree=divide_curve_3.Points)  # -> Paths, Length, Count
repeat_data = RepeatData(Data="0.2", Length=tree_statistics.Length)

sub_list = SubList(List=stream_filter_2, Domain=construct_domain, Wrap=True)  # -> List, Index

stream_filter_3 = StreamFilter(Gate=0, Stream0=stream_filter_2, Stream1=sub_list.List)

reduce = Reduce(Polyline=stream_filter_3, Tolerance=0)  # -> Polyline, Reduction
explode = Explode(Curve=reduce.Polyline, Recursive=True)  # -> simplify(Segments), Vertices
entwine = Entwine(Branch0X=divide_curve_3.Tangents, Branch1X=explode.Segments, FlattenInputs=False)
control_points = ControlPoints(Curve=reduce.Polyline)  # -> simplify(Points), Weights, Knots
entwine_2 = Entwine(Branch0X=divide_curve_3.Points, Branch1X=control_points.Points, FlattenInputs=False)
renumber_paths = RenumberPaths(Data=entwine)
renumber_paths_2 = RenumberPaths(Data=entwine_2)
plane_normal = PlaneNormal(Origin=renumber_paths_2, ZAxis=renumber_paths)
align_planes = AlignPlanes(Planes=plane_normal, Master=yz_plane)
polyline_planes = Plane(align_planes)

polyline_6 = PolyLine(Vertices=renumber_paths_2, Closed=False)

list_length = ListLength(List=stream_filter_3)  # -> expr("x-1", Length)
loop_start = LoopStart(Count=list_length)  # -> port, Data, Counter
addition = Addition(A=tree_statistics.Count, B=loop_start.Counter)
tree_branch = TreeBranch(Tree=renumber_paths_2, Path=addition, MaintainPaths=True)
list_item = ListItem(List=flatten(polyline_6), Index=expr("x-1", addition), Wrap=False)
curve_closest_point = CurveClosestPoint(Point=tree_branch, Curve=list_item)  # -> Point, Parameter, Distance
loop_end = LoopEnd(port=loop_start.port, Data=curve_closest_point.Distance, state="Last & Record")  # -> simplify(Data)
minimum = Minimum(A=loop_end, B=0.35)
entwine_3 = Entwine(Branch0X=simplify(repeat_data), Branch1X=minimum, FlattenInputs=False)

data_dam = DataDam(DataDataA=entwine_3, BufferDelay=10000000, BufferMode=0)

# ----
# Retract First and last Plane
planes = Plane(simplify(polyline_planes))
list_item_2 = ListItem(List=flatten(planes), Index=0, Wrap=True)  # -> Item1, Item
tree_statistics_2 = TreeStatistics(Tree=planes)  # -> Paths, Length, Count
multiplication_2 = Multiplication(A=tree_statistics_2.Count, B=0.5)
unit_z_2 = UnitZ(Factor=Slider(100, range=0..100))
subtraction = Subtraction(A=multiplication_2, B=1)
multiplication_3 = Multiplication(A=tree_statistics_2.Count, B=0.5)
move = Move(Geometry=list_item_2.Item1, Motion=unit_z_2)  # -> Geometry, Transform
move_2 = Move(Geometry=list_item_2.Item, Motion=unit_z_2)  # -> Geometry, Transform
sequence = Sequence(Notation="[N-1] + 2 ", Length=subtraction, Initial=1)
sequence_2 = Sequence(Notation="[N-1] + 2 ", Length=multiplication_3, Initial=0)
tree_branch_2 = TreeBranch(Tree=planes, Path=sequence, MaintainPaths=True)  # -> reverse(Branch)
tree_branch_3 = TreeBranch(Tree=planes, Path=sequence_2, MaintainPaths=True)
merge_4 = Merge(Data1=tree_branch_3, Data2=tree_branch_2)
planes_2 = Plane(merge_4)

# ----
# Calculate Curvature Radii
plane = Plane(planes_2)
tree_statistics_3 = TreeStatistics(Tree=simplify(plane))  # -> Paths, graft(Length), Count
# Generation of Movement Points between Section D and C
subtraction_2 = Subtraction(A=tree_statistics_3.Length, B=1)
construct_domain_2 = ConstructDomain(DomainStart=0, DomainEnd=subtraction_2)
# Slicing Curves
range = Range(Domain=construct_domain_2, Steps=subtraction_2)  # -> simplify(Range)
stream_filter_4 = StreamFilter(Gate=Toggle(True), Stream0=Slider(1, range=0..6), Stream1=tree_statistics_3.Paths)
tree_branch_4 = TreeBranch(Tree=range, Path=stream_filter_4, MaintainPaths=True)
tree_item = TreeItem(Tree=simplify(plane), Path=graft(stream_filter_4), Index=tree_branch_4, Wrap=True)
nurbs_curve = NurbsCurve(Vertices=tree_item, Degree=2, Periodic=False)  # -> reparameterize(Curve), Length, Domain
curve_closest_point_2 = CurveClosestPoint(Point=tree_item, Curve=nurbs_curve.Curve)  # -> Point, Parameter, Distance
curvature = Curvature(Curve=nurbs_curve.Curve, Parameter=curve_closest_point_2.Parameter)  # -> Point, Curvature, Curvature_2
radial_dimension = RadialDimension(Curve=reparameterize(curvature.Curvature_2))  # -> simplify(RadialDimension)
# Vector Generation
bounds = Bounds(Numbers=radial_dimension)
deconstruct_domain = DeconstructDomain(Domain=bounds)  # -> Start, End
smallest_radius_of_curvature_in_layer = Panel(deconstruct_domain.Start)
panel_2 = Panel(radial_dimension)
data = Data(radial_dimension)

# ----
# Define Buildplate
image_sampler = ImageSampler(Filter="Colour", Interpolate=False, Umax=1, Umin=0, Vmax=1, Vmin=0, Wrap=1)
robotsystem_parameter_2 = RobotSystemParameter(robotsystem_parameter)

# ----
# Point Right
tool_position_in_base = Panel("""-0.174804
-0.315077
0.009059
1.2327
2.868966
0.087288""")
get_plane = GetPlane(Numbers=tool_position_in_base, RobotSystem=robotsystem_parameter_2)
point_right_plane = Plane(get_plane)

# ----
# Origin
tool_position_in_base_2 = Panel("""-0.180864
-0.673597
0.009886
-0.537726
-2.856868
0.310277""")
get_plane_2 = GetPlane(Numbers=tool_position_in_base_2, RobotSystem=robotsystem_parameter_2)
origin_plane = Plane(get_plane_2)

# ----
# Point Down
tool_position_in_base_3 = Panel("""0.181982
-0.67656
0.009488
-0.077117
2.939472
-0.325756""")
get_plane_3 = GetPlane(Numbers=tool_position_in_base_3, RobotSystem=robotsystem_parameter_2)
point_down_plane = Plane(get_plane_3)

# ----
# Measure TCP
# Comment: The Tool TCP Of your Probe
tool_tcp = Panel(tool_tcp_numbers)
robot_tcp_numbers_2 = Number(robot_tcp_numbers)
tool_tcp_numbers_2 = Number(tool_tcp_numbers)
tcp_probe = Panel("""0
0
0.195
0
0
0""")
robotsystem_parameter_3 = RobotSystemParameter(robotsystem_parameter)

get_plane_4 = GetPlane(Numbers=tcp_probe, RobotSystem=robotsystem_parameter_3)
get_plane_5 = GetPlane(Numbers=tool_tcp_numbers_2, RobotSystem=robotsystem_parameter_3)
get_plane_6 = GetPlane(Numbers=robot_tcp_numbers_2, RobotSystem=robotsystem_parameter_3)
xy_plane_2 = XYPlane(Origin=Point(0, 0, 0))
orient = Orient(Geometry=xy_plane_2, Source=get_plane_5, Target=get_plane_6)  # -> Geometry, Transform
probe_plane = Plane(get_plane_4)
orient_2 = Orient(Geometry=probe_plane, Source=PlaneXY(0, 0, 0), Target=orient.Geometry)  # -> Geometry, Transform
from_plane = FromPlane(Plane=orient_2.Geometry, RobotSystem=robotsystem_parameter_3)
panel_3 = Panel("""1000
1000
1000
1
1
1""")
multiplication_4 = Multiplication(A=from_plane, B=panel_3)

real_world_plane = Plane(orient_2.Geometry)
position_in_m = Number(from_plane)
position_in_mm = Number(multiplication_4)
position_from_robot = Panel(position_in_m)

point_right_plane_2 = Plane(point_right_plane)
origin_plane_2 = Plane(origin_plane)
point_down_plane_2 = Plane(point_down_plane)

rectangle_3pt = Rectangle3Pt(PointA=origin_plane, PointB=point_right_plane, PointC=point_down_plane)  # -> Rectangle, Length
vector_2pt = Vector2Pt(PointA=origin_plane_2, PointB=point_right_plane_2, Unitize=False)  # -> Vector, Length
vector_2pt_2 = Vector2Pt(PointA=origin_plane_2, PointB=point_down_plane_2, Unitize=False)  # -> Vector, Length
centermark = Centermark(Plane=rectangle_3pt.Rectangle)  # -> Centermark, CenterPoint
reverse = Reverse(Vector=vector_2pt_2.Vector)
construct_plane_2 = ConstructPlane(Origin=centermark.CenterPoint, XAxis=vector_2pt.Vector, YAxis=reverse)
align_plane = AlignPlane(Plane=construct_plane_2, Direction=vector_2pt_2.Vector)  # -> Plane, Angle

symbol_simple = SymbolSimple(Style=6, Size=5, Rotation=0, Colour=RGB(255, 0, 200))
symbol_display = SymbolDisplay(Location=construct_plane_2, Display=symbol_simple)

orient_target_plane = Plane(align_plane.Plane)

python_3_script_2 = Python3Script(toolpath=flatten(planes_2), robot=robotsystem_parameter, buildArea=rectangle_3pt.Rectangle, tool=update_tool)  # -> a; inputs toolpath: list of Plane, buildArea: Rectangle3d
# ---------- python_3_script_2: Python ----------
import Rhino.Geometry as rg
import math
import numpy as np
from scipy.optimize import minimize
import Robots

# Ensure you have the 'Robots' library available in your path
# or referenced in your GHPython component.

def get_optimized_location():
    # 1. Extract constraints from the Grasshopper Rectangle
    plane = _buildArea.Plane
    x_domain = _buildArea.X
    y_domain = _buildArea.Y
    
    # Pre-filter toolpath for speed (keep curvature-heavy points)
    # We take every Nth point for the optimization phase
    sample_rate = 20 
    sampled_path = _toolpath[::sample_rate]

    def objective(params):
        tx, ty, tr = params
        
        # Create transformation for the build location
        # Translation within the rectangle + Rotation around rectangle center
        move = rg.Transform.Translation(plane.XAxis * tx + plane.YAxis * ty)
        rot = rg.Transform.Rotation(tr, plane.ZAxis, plane.Origin)
        total_xform = rot * move
        
        total_joint_travel = 0
        prev_q = None
        
        for p in sampled_path:
            # Transform the toolpath plane to the candidate location
            target_plane = rg.Plane(p)
            target_plane.Transform(total_xform)
            
            # In 'Robots', we usually use the Kinematics of the system
            # To get IK, we need a Target. We create a simple Cartesian target.
            target = Robots.CartesianTarget(
                                            target_plane, 
                                            None,                     # Configuration (Nullable)
                                            Robots.Motions.Joint,     # Motion type (Explicit Enum)
                                            _tool, 
                                            None,                     # Speed
                                            None,                     # Zone
                                            None,                     # Command
                                            None                      # Frame
                                            )
            
        # Solve IK using the robot's kinematics
            # 'InverseKinematics' returns an array of solutions (double[][])
            # 'kinematics' returns all 8 possible solutions usually
            kinematic_results = _robot.Kinematics([target])
            
            if not kinematic_results or len(kinematic_results) == 0:
                return 1e12
            
            # Get the joint solutions from the first result
            solutions = kinematic_results[0].Joints
                        
            if not solutions or len(solutions) == 0:
                return 1e12 
            
            # Select closest solution (using your existing logic)
            if prev_q is None:
                q_curr = solutions[0]
            else:
                q_curr = min(solutions, key=lambda sol: sum((a - b)**2 for a, b in zip(sol, prev_q)))

        # --- CONSTRAINT: Singularity Penalty ---
            # Most 6-axis robots hit singularity when J5 is near 0 radians
            j5_angle = abs(q_curr[4])
            if j5_angle < 0.1:
                total_joint_travel += 1e5 / (j5_angle + 0.01)

        # --- CONSTRAINT: Floor Collision ---
            # Check if Tool or Wrist (J5) goes below the buildplate plane ALSO INCLUDE J3, J4, J6
            joints_geometry = _robot.GetJointPositions(q_curr) 
            for pt in joints_geometry:
                if pt.Z < plane.OriginZ - 1.0: # 1mm safety buffer
                    return 1e15

        # --- COST: Joint Travel ---
            if prev_q is not None:
                total_joint_travel += sum((a - b)**2 for a, b in zip(q_curr, prev_q))
            
            prev_q = q_curr
            
        return total_joint_travel

    # 2. Run Optimization
    # Initial guess: Center of the rectangle [0, 0], no rotation [0]
    initial_guess = [x_domain.Mid, y_domain.Mid, 0]
    bounds = [(x_domain.T0, x_domain.T1), (y_domain.T0, y_domain.T1), (-math.pi, math.pi)]
    
    res = minimize(objective, initial_guess, method='L-BFGS-B', bounds=bounds)
    
    # 3. Final Output Transformation
    best_x, best_y, best_tr = res.x
    final_move = rg.Transform.Translation(plane.XAxis * best_x + plane.YAxis * best_y)
    final_rot = rg.Transform.Rotation(best_tr, plane.ZAxis, plane.Origin)
    
    return final_rot * final_move

# Execution
if _toolpath and _robot and _buildArea:
    a = get_optimized_location() # Output 'a' is the final Transform
# ---------- end python_3_script_2 ----------

list_item_3 = ListItem(List=stream_filter_3, Index=0, Wrap=True)
polygon_center = PolygonCenter(Polyline=list_item_3)  # -> CenterV, CenterE, CenterA
move_in_x = Slider(0, range=-100..100)
move_in_y = Slider(-6, range=-100..100)
deconstruct_vector = DeconstructVector(Vector=polygon_center.CenterE)  # -> XComponent, YComponent, ZComponent
vector_xyz = VectorXYZ(XComponent=deconstruct_vector.XComponent, YComponent=0, ZComponent=0)  # -> Vector, Length
vector_xyz_2 = VectorXYZ(XComponent=move_in_x, YComponent=move_in_y, ZComponent=0)  # -> Vector, Length

# ----
# Print Head Tilt Settings
# Orient to Location
# Comment: This Moves the Target Planes from the Base (0,0,0) Coordinate System to our Work Location.
toolpath_planes = Plane(planes_2)
xy_plane_3 = XYPlane(Origin=vector_xyz.Vector)
orient_target_plane_2 = Plane(orient_target_plane)
image_sampler_2 = ImageSampler(Filter="Colour", Interpolate=False, Umax=1, Umin=0, Vmax=1, Vmin=0, Wrap=1)
unit_z_3 = UnitZ(Factor=1)

move_3 = Move(Geometry=xy_plane_3, Motion=vector_xyz_2.Vector)  # -> Geometry, Transform

orient_3 = Orient(Geometry=toolpath_planes, Source=move_3.Geometry, Target=orient_target_plane_2)  # -> Geometry, Transform
oriented_planes = Plane(orient_3.Geometry)

list_2 = ValueList({"Joint", "Linear", "Process", "Servo"}, selected="Linear")

# ----
# Create Targets
tool_parameter = ToolParameter(update_tool)
list_3 = ValueList({"Joint", "Linear", "Process", "Servo"}, selected="Servo")

# ---- group: Rotate Target
# Comment: Rotate the Target Planes along their Z-Axis
rotation = Slider(0, range=-360..360)
oriented_planes_2 = Plane(oriented_planes)
image_sampler_3 = ImageSampler(Filter="Colour", Interpolate=False, Umax=1, Umin=0, Vmax=1, Vmin=0, Wrap=1)

radians = Radians(Degrees=rotation)
rotate_plane = RotatePlane(Plane=oriented_planes_2, Angle=radians)

oriented_rotated_planes = Plane(rotate_plane)

# ----
mesh_plane = MeshPlane(Boundary=rectangle_3pt.Rectangle, WidthCount=10, HeightCount=10)  # -> Mesh, Area
unit_z_4 = UnitZ(Factor=Slider(-22, range=-100..10))
move_4 = Move(Geometry=mesh_plane.Mesh, Motion=unit_z_4)  # -> Geometry, Transform
range_2 = Range(Domain=Domain(0, 7), Steps=7)

simulation_time = Slider(0, range=0..1)

# ---- group: Adjust Depth
z_shift = Slider(-0.5, range=-15..80)
oriented_rotated_planes_2 = Plane(oriented_rotated_planes)

deconstruct_plane = DeconstructPlane(Plane=oriented_rotated_planes_2)  # -> Origin, XAxis, YAxis, ZAxis
amplitude = Amplitude(Vector=unit_z_3, Amplitude=z_shift)
move_5 = Move(Geometry=oriented_rotated_planes_2, Motion=amplitude)  # -> Geometry, Transform

# ----
data_dam_2 = DataDam(DataDataA=move_5.Geometry, BufferDelay=10000000, BufferMode=0)

# ---- group: Adjust Depth (continued)
oriented_rotated_planes_3 = Plane(data_dam_2)

# ----
# Simulation and Motion Testing
planes_3 = Plane(oriented_rotated_planes_3)
list_length_2 = ListLength(List=flatten(planes_3))

subtraction_3 = Subtraction(A=list_length_2, B=1)
create_target_2 = CreateTarget(Plane=planes_3, Motion=list_2, Tool=tool_parameter, IsCartesian=True)  # -> flatten(Target)

loop_start_2 = LoopStart(Count=subtraction_3)  # -> port, Data, Counter
list_item_4 = ListItem(List=create_target_2, Index=loop_start_2.Counter, Wrap=False)
kinematics = Kinematics(RobotSystem=robotsystem_parameter, Target=list_item_4, PreviousJoints=loop_start_2.Data, DisplayGeometry=False)  # -> Meshes, Joints, Planes, Errors
# Simulate Program
loop_end_2 = LoopEnd(port=loop_start_2.port, Data=kinematics.Joints, state="Last & Record")
list_item_5 = ListItem(List=flatten(create_target_2), Index=0, Wrap=True)

merge_5 = Merge(
    Data1=ColourSwatch(SwatchColor=RGB(235, 38, 235)),
    Data2=ColourSwatch(SwatchColor=RGB(53, 222, 118)),
    Data3=ColourSwatch(SwatchColor=RGB(214, 36, 36)),
    Data4=ColourSwatch(SwatchColor=RGB(0, 76, 255)),
    Data5=ColourSwatch(SwatchColor=RGB(140, 227, 0)),
    Data6=ColourSwatch(SwatchColor=RGB(102, 102, 102)),
    Data7=ColourSwatch(SwatchColor=RGB(133, 43, 207)),
    Data8=ColourSwatch(SwatchColor=RGB(74, 74, 74)))

# ----
# Merge Targets
start_joint_target_2 = TargetParameter(start_joint_target)

merge_6 = Merge(Data1=start_joint_target_2, Data2=create_target_2)
data_dam_3 = DataDam(DataDataA=merge_6, BufferDelay=10000000, BufferMode=0)

# ---- group: Division
# Servo Parameters
average_tool_speed_mm_s = Slider(4, range=1..20)
deconstruct_plane_2 = DeconstructPlane(Plane=oriented_rotated_planes_3)  # -> Origin, XAxis, YAxis, ZAxis
shift_list_2 = ShiftList(List=deconstruct_plane_2.Origin, Shift=1, Wrap=False)
distance = Distance(PointA=deconstruct_plane_2.Origin, PointB=shift_list_2)
division_3 = Division(SegmentDistance=distance, ToolSpeed=average_tool_speed_mm_s)  # -> flatten(Result)

average = Average(Input=division_3)
shift_list_3 = ShiftList(List=distance, Shift=-1, Wrap=True)
lookahead_time = Slider(0.08, range=0.02..0.25)
gain = Slider(600, range=200..700)

division_4 = Division(A=average, B=0.008)
round = Round(Number=division_4)  # -> Nearest, Floor, Ceiling
multiplication_5 = Multiplication(A=round.Nearest, B=0.008)
merge_7 = Merge(Data1=graft(multiplication_5), Data2=graft(lookahead_time), Data3=graft(gain))
text_join_2 = TextJoin(Text=merge_7, Join=",")

# ----
servo_parameters = ServoParameters(text_join_2)
create_target_3 = CreateTarget(Joints=loop_end_2, Motion=list_3, Tool=tool_parameter, Servo=servo_parameters, IsCartesian=False)

merge_8 = Merge(Data1=flatten(list_item_5), Data2=flatten(create_target_3))
toolpath_targets = TargetParameter(merge_8)

toolpath_targets_2 = TargetParameter(toolpath_targets)
merge_9 = Merge(Data1=start_joint_target_2, Data2=toolpath_targets_2, Data3=start_joint_target_2)
program_targets = TargetParameter(merge_9)

# ----
# Upload 3D-printing Program
panel_4 = Panel("C:\Users\pjvth\High-tech Engineering\Thesis\Grasshopper control\Grasshopper python scripts\GH_program_3Dprinting.script")
from_plane_2 = FromPlane(Plane=oriented_rotated_planes_3, RobotSystem=robotsystem_parameter)  # -> simplify(Numbers)
python_3_script_3 = Python3Script(
    T=multiplication_5,
    PPL=flatten(tree_statistics_3.Length),
    LT=lookahead_time,
    G=gain,
    filepath=panel_4,
    export=Button(),
    ROBOT_IP=robot_ip_txt,
    REMOTE_NAME="GH_3Dprinting.script")  # inputs T: list of String, PPL: list of String, LT: String, G: String, filepath: String, export: Boolean, REMOTE_NAME: String
# ---------- python_3_script_3: Python ----------
import Grasshopper as gh
import paramiko
import socket

def upload_program_to_robot(robot_ip, local_file_path, remote_filename):
    # Standard UR Credentials
    username = "root"
    password = "easybot" # Default for CB3. For e-Series, use your system admin password.
    port = 22

    print(f"Connecting to {robot_ip}...")

    try:
        # 1. Initialize SSH Client
        ssh = paramiko.SSHClient()
        ssh.set_missing_host_key_policy(paramiko.AutoAddPolicy()) # Automatically trust the robot's key
        ssh.connect(robot_ip, port, username, password)

        # 2. Initialize SFTP on top of SSH
        sftp = ssh.open_sftp()
        
        # 3. Define remote path (UR stores programs in /programs)
        remote_path = f"/programs/{remote_filename}"
        
        # 4. Upload the file
        print(f"Uploading {local_file_path} to {remote_path}...")
        sftp.put(local_file_path, remote_path)
        
        print("Upload Successful!")

        # 5. Close connections
        sftp.close()
        ssh.close()

    except Exception as e:
        print(f"An error occurred: {e}")

# --- Script Assembly ---
def assemble_program(PPL, G, T, LT):
    # 1. Header with Setup
    header = """def extrusion_program():
    socket_open("172.19.126.244", 3000, "laptop_socket")
    socket_open("172.19.126.242", 23, "duet_socket")
    sleep(1.5)
    set_tcp(p[0, 0, 0.19677, -1.2092, -1.2092, 1.2092])
    set_payload(0.72, [0.00001, 0.00013, 0.07588])
    """

    # 2. Calculate the indentation to align exactly under the first 'p'  
    ppl_str =       "    global poses_per_layer = [" + ", ".join([x for x in PPL]) + "]"
    time_str =      "    global time = "+"".join([x for x in T])
    lt_str =        "    global lt = "+"".join([x for x in LT])
    gain_str =      "    global g = "+"".join([x for x in G])
    
    # 3. Footer (Logic and Loops)
    footer = """
    global extrusion_trigger = False
    global thread_val_E = 0
    global thread_val_F = 0 
    global target_pose = p[0,0,0,0,0,0]
    global raw_data = [0,0,0,0,0,0,0,0,0]

    def fetch_next_pose():
        socket_send_string("NEXT", "laptop_socket")
        # We now expect 8 floats: [x, y, z, rx, ry, rz, height, distance]
        data = socket_read_ascii_float(8, "laptop_socket")
        return data
    end

    raw_data = fetch_next_pose()
    if raw_data[0] < 8:
        popup("Error: Could not fetch initial waypoint", "Error", error=True)
        halt
    end

    thread ExtruderControl():
        while True:
            if extrusion_trigger == True:
                socket_send_string("G1 E", "duet_socket")
                socket_send_string(thread_val_E, "duet_socket")
                socket_send_string(" F", "duet_socket")
                socket_send_string(thread_val_F, "duet_socket")
                socket_send_byte(10, "duet_socket")
                extrusion_trigger = False
            end
            sync()
        end
    end

    ext_thread_handle = run ExtruderControl()
    
    # Heating
    popup("For Heating and Priming Nozzle press CONTINUE.", "Set up hotend", blocking=True)
    socket_send_line("T0", "duet_socket")  
    socket_send_line("M109 S200", "duet_socket")
    socket_send_line("G1 E30 F300", "duet_socket")
    sleep(3)
    
    layer_idx = 0
    pose_pointer = 0
    num_layers = length(poses_per_layer)

    target_pose = p[raw_data[1], raw_data[2], raw_data[3], raw_data[4], raw_data[5], raw_data[6]]

    popup("If Nozzle is primed press CONTINUE to move to the start position", "Start", blocking=True)
    movej(target_pose, a=1.0, v=0.1)

    keep_printing = True
    while keep_printing:
        while layer_idx < num_layers:
            poses_in_this_layer = poses_per_layer[layer_idx]
            i = 0

            while i < poses_in_this_layer:
                raw_data = fetch_next_pose()
                if raw_data[0] >= 6:
                    target_pose = p[raw_data[1], raw_data[2], raw_data[3], raw_data[4], raw_data[5], raw_data[6]]
                    h = raw_data[7]
                    dist = raw_data[8]
                    textmsg("layer height = ", h)
                    textmsg("distance = ", dist)
                    
                    thread_val_E = 0.08*((0.35 * h * dist)/0.126)
                    thread_val_F = (thread_val_E / time) * 60
                    extrusion_trigger = True

                    # Execute real-time motion
                    servoj(get_inverse_kin(target_pose), t=time, lookahead_time=lt, gain=g)
                else:
                    textmsg("Warning: Failed to receive pose at pointer ", pose_pointer)
                    keep_printing = False
                end

                pose_pointer = pose_pointer + 1
                i = i + 1
            end
            # --- RETRACTION LOGIC START ---
            #socket_send_line("G1 E-2 F1800", "duet_socket")
            #socket_send_line("G1 E2 F1800", "duet_socket")
            #movej(waypoints[pose_pointer], a=1.0, v=0.07)
            #sync()
            # --- RETRACTION LOGIC END ---
            layer_idx = layer_idx + 1
        end 
    end

    kill ext_thread_handle 
    # Turn off heaters
    socket_send_line("T0", "duet_socket")  
    socket_send_line("M104 S0", "duet_socket")
    # socket_send_byte(10, "duet_socket")
    movej([1.57, -1.57, 1.57, -1.57, -1.57, 0], a=1, v=0.3, r=0)
    textmsg("Program finished and thread killed -> turn off hotend.")
    socket_close("duet_socket")
end
extrusion_program()
    """

    # Combine
    full_script = header  + "\n" + ppl_str + "\n" + gain_str + "\n" + lt_str + "\n" + time_str + "\n" + footer
    return full_script

# print(poses)
if export==True:
    with open(filepath, 'w') as f:
        f.write(assemble_program(PPL, G, T, LT))
    upload_program_to_robot(ROBOT_IP, filepath, REMOTE_NAME)
# ---------- end python_3_script_3 ----------
python_3_script_4 = Python3Script(
    P=from_plane_2,
    H=flatten(data_dam),
    D=flatten(shift_list_3),
    ROBOT_IP=robot_ip_txt,
    LAPTOP_IP="172.19.126.244",
    connect=Button())  # inputs P: tree of Double, H: list of Double, D: list of Double, ROBOT_IP: String, LAPTOP_IP: String, connect: Boolean
# ---------- python_3_script_4: Python ----------
import Grasshopper as gh
import socket

def parse_orientations(P):
    # Create a new DataTree to hold the strings
    output_tree = gh.DataTree[str]()
    waypoint_list = []
    # Iterate through each branch in the input tree
    for i in range(P.BranchCount):
        branch = P.Branch(i)
        
        # Format the floats into your specific string
        coords = ", ".join(["{:.6f}".format(n) for n in branch])
                
        # Add to the new tree at the same path
        waypoint_list.append(coords)

    # Assign to output
    return waypoint_list

def send_waypoint2robot(robot_ip, laptop_ip, P, H, D):
    # Your list of waypoints (can be thousands long)
    waypoints = parse_orientations(P)
    layer_heights = [str(item) for item in H]
    distances = [str(item) for item in D]

    server = socket.socket(socket.AF_INET, socket.SOCK_STREAM)
    server.setsockopt(socket.SOL_SOCKET, socket.SO_REUSEADDR, 1)
    server.bind((laptop_ip, 3000))
    server.listen(1)

    print("Waiting for UR5 connection...")
    conn, addr = server.accept()
    print(f"Connected by {addr}")

    try:
        # 3. Use zip to iterate through all three lists at once
        for w, h, d in zip(waypoints, layer_heights, distances):
            # Wait for the request from the robot
            data = conn.recv(1024).decode()
            
            if "NEXT" in data:
                # Combine the data into one string per "NEXT" signal
                # Format: "(waypoint_data, height, distance)"
                message = f"({w}, {h}, {d})\n"
                conn.sendall(message.encode())
            else:
                # Optional: handle unexpected messages
                print(f"Unexpected data received: {data}")
                break

        # 4. Send the STOP signal after the loop finishes
        conn.sendall("STOP\n".encode())

    finally:
        # 5. Close the connection only after everything is done
        conn.close()
        server.close()
        print("Connection closed.")

if connect==True:
    send_waypoint2robot(ROBOT_IP, LAPTOP_IP, P, H, D)
# ---------- end python_3_script_4 ----------

# ----
# Create Program
panel_5 = Panel("popup(\"press CONTINUE to start the program\", \"StartConfirmation\",warning=False, error=False, blocking=True)")
data_dam_4 = DataDam(DataDataA=program_targets, BufferDelay=10000000, BufferMode=0)
programname = Panel("Lshape_tuned")
custom_command = CustomCommand(Name="CustomCommand", Manufacturer="UR", Code=panel_5)
robotsystem_parameter_4 = RobotSystemParameter(robotsystem_parameter)
number_slider_3 = Slider(0.5, range=0..10)
command_parameter = CommandParameter(custom_command)
target_parameter = TargetParameter(flatten(data_dam_4))

# ----
# Upload Motion Program
use_ftp_upload = BooleanToggle(True)
ftp_prefix = Panel("sftp://")
robot_ip_txt_3 = Text(robot_ip_txt)
concatenate = Concatenate(Fragment_A=ftp_prefix, Fragment_C=robot_ip_txt_3)
boolean = Boolean(use_ftp_upload)
upload = Button()
stream_filter_5 = StreamFilter(Gate=boolean, Stream0=robot_ip_txt_3, Stream1=concatenate)
gate_or = GateOr(B=upload)
boolean_2 = Boolean(gate_or)
robotip_txt = Text(stream_filter_5)

get_current_time = GetCurrentTime(get_time=boolean_2)  # -> out, time_string; inputs get_time: Boolean
# ---------- get_current_time: Python ----------
"""Provides a scripting component.
    Inputs:
       
    Output:
        a: The a output variable"""

__author__ = "robin godwyll"

import rhinoscriptsyntax as rs
from datetime import datetime 

def give_time(): 
    time = datetime.now()
    time_string = time.strftime("%m%d%H%M")
    return time_string
    
if get_time: 
    time_string = give_time()
# ---------- end get_current_time ----------
concatenate_2 = Concatenate(Fragment_A=programname, A=get_current_time.time_string)
create_program = CreateProgram(
    Name=concatenate_2,
    RobotSystem=robotsystem_parameter_4,
    Targets=target_parameter,
    InitCommands=command_parameter,
    StepSize=number_slider_3)  # -> Program, Code, Duration, Warnings, Errors
program_parameter = ProgramParameter(create_program.Program)
program_duration = Number(create_program.Duration)
program_code = Text(create_program.Code)
warnings = Text(create_program.Warnings)
errors = Text(create_program.Errors)

create_program_2 = CreateProgram(Name=concatenate_2, RobotSystem=robotsystem_parameter_4, Targets=data_dam_3, StepSize=number_slider_3)  # -> Program, Code, Duration, Warnings, Errors
check_collisions = CheckCollisions(
    Program=create_program_2.Program,
    FirstSet=range_2,
    SecondSet=8,
    Environment=move_4.Geometry,
    EnvironmentPlane=-1,
    LinearStepSize=Slider(1, range=0..1),
    AngularStepSize=0.7853981634)  # -> CollisionFound, TargetIndex, CollidedMeshes
panel_6 = Panel(check_collisions.CollisionFound)
panel_7 = Panel(check_collisions.CollidedMeshes)

program_simulation = ProgramSimulation(Program=create_program_2.Program, Time=simulation_time, Normalized=True)  # -> SystemMeshes, JointRotations, Plane, Index, Time, Program, Errors
index = Panel(program_simulation.Index)
time = Panel(program_simulation.Time)
number = Number(program_simulation.JointRotations)
plane_2 = Plane(program_simulation.Plane)
deconstruct_program_targets = DeconstructProgramTargets(Program=program_simulation.Program)  # -> Planes, Joints, Configuration, DeltaTime
add_rotation_tag_to_joints = AddRotationTagToJoints(joint_rotation=number, joint_planes=plane_2)
list_item_6 = ListItem(List=deconstruct_program_targets.Planes, Index=-1, Wrap=True)  # -> flatten(Item)
split_list = SplitList(List=list_item_6, Index=index)  # -> ListA, ListB
polyline_7 = PolyLine(Vertices=split_list.ListA, Closed=False)

mesh = Mesh(program_simulation.SystemMeshes)
custom_preview = CustomPreview(Geometry=mesh, Material=merge_5)

# ---- group: Robot Program Output
code = Text(program_code)
errors_2 = Text(errors)
warnings_2 = Text(warnings)
program_parameter_2 = ProgramParameter(program_parameter)

program_code_2 = Panel(code)
errors_3 = Panel(errors_2)
program = Panel(program_parameter_2)
warnings_3 = Panel(warnings_2)

# ----
program_parameter_3 = ProgramParameter(program_parameter)
remote_connection = RemoteConnection(Program=program_parameter_3, IP=robotip_txt, Upload=boolean_2, Play=False, Pause=False)
connection_log_txt = Text(remote_connection)
panel_8 = Panel(connection_log_txt)

# ----
# Robot Code [EXPORT]
panel_9 = Panel("C:\Users\pjvth\High-tech Engineering\Thesis\Grasshopper control\UR5 program files")
stream_gate = StreamGate(Stream=panel_9, Gate=Button())
panel_10 = Panel(program_parameter)
save_program = SaveProgram(Program=program_parameter, Folder=stream_gate)

# ==== cluster AddRotationTagToJoints
joint_rotation = ClusterInput()
joint_planes = ClusterInput()
joint_rotation_2 = Number(joint_rotation)
joint_planes_2 = Plane(joint_planes)
degrees = Degrees(Radians=joint_rotation_2)
absolute = Absolute(Value=degrees)
decimal_place = Panel("2")
round_to_decimal_place = RoundToDecimalPlace(NumberX=degrees, DecimalPlace=decimal_place, RoundType=0)  # -> Rounded, Difference
format_radians = Panel("({0:0.000 rad})")
division = Division(A=absolute, B="360")
format = Format(Format=format_radians, Culture=127, Data0=joint_rotation_2)
panel = Panel("""Base
Shoulder
Elbow
Wrist 1
Wrist 2
Wrist 3""")
gradient = Gradient(LowerLimit=0, UpperLimit=1, Parameter=division, stops=[0: RGB(19, 189, 0), 0.776: RGB(0, 39, 130), 1: RGB(220, 0, 40)])
concat = Concatenate(FragmentA=round_to_decimal_place.Rounded, FragmentB="°")
merge = Merge(Data1=simplify(graft(panel)), Data2=simplify(graft(concat)))
newline = Panel("")
text_join = TextJoin(Text=merge, Join=newline)
text_tag = TextTag(Location=graft(joint_planes_2), Text=text_join, Colour=graft(gradient))
