# Grasshopper definition servoj_ghScript optimization.gh (Grasshopper 1.0.8)
# plug-ins: Robots, RobotsExtended, treesloth01, Opossum2_0_Proto_A

average_layer_height = Slider(0.2, range=0..1)

# ----
# Load Robot
list = RobotsLibrary({"UR3e", "UR5e", "UR10e", "UR16e", "UR3", "UR5", "UR10", "UR20", "UR30"}, selected="UR5", Type=0)
load_robot_system = LoadRobotSystem(Name=list, Base=PlaneXY(0, 0, 0))
robotsystem_parameter = RobotSystemParameter(load_robot_system)

# ----
# Send to Robot
choose_a_robot = ValueList({"Robotarm": 0, "Robotarm 2": 1}, selected="Robotarm")
robotarm_ip_address = Panel("172.19.126.241")
robotarm_2_ip_address = Panel("172.19.126.245")
stream_filter = StreamFilter(Gate=choose_a_robot, Stream0=robotarm_ip_address, Stream1=robotarm_2_ip_address)
robot_ip_txt = Text(stream_filter)

# ---- group: Get Data From RObot
get_robot_position = Button()
robot_ip_txt_2 = Text(robot_ip_txt)
get_robot_position_2 = Script(run=get_robot_position, ip_address=robot_ip_txt_2)  # -> tcp, tool; inputs run: Boolean, ip_address: String
# ---------- get_robot_position_2: Python ----------
import socket
import struct
import math
from datetime import datetime

def connect_to_ur_robot(host, port=30002):
    try:
        s = socket.create_connection((host, port), timeout=3.0)
        print(f"Connected to UR robot at {host}:{port}")
        return s
    except Exception as e:
        now = datetime.now()
        print(f"{now:%Y-%m-%d/%H:%M:%S}: Failed to connect to UR robot: {e}")
        return None

def parse_info(data):
    """Parses Cartesian info and tool offsets from the robot's data."""
    try:
        header_size = 5
        if len(data) > header_size:
            size, ptype = struct.unpack("!iB", data[:header_size])
            print(ptype, size)
            if ptype == 16: 
                print("Received Robot State Message" , size)
                data = data[header_size:]
                while data: 
                    print("Subpackage", "remaining data:", len(data))
                    size, ptype = struct.unpack("!iB", data[:header_size])
                    print("Subpackage type: ", ptype, size)
                    if ptype == 4: # Cartesian Information
                        format_str = "!dddddddddddd"
                        unpacked = struct.unpack(format_str, data[header_size:header_size + struct.calcsize(format_str)])
                        print(unpacked)
                        cartesian_info = {
                            "X": unpacked[0], "Y": unpacked[1], "Z": unpacked[2],
                            "Rx": unpacked[3], "Ry": unpacked[4], "Rz": unpacked[5],
                            "tcpOffsetX": unpacked[6], "tcpOffsetY": unpacked[7], "tcpOffsetZ": unpacked[8],
                            "tcpOffsetRx": unpacked[9], "tcpOffsetRy": unpacked[10], "tcpOffsetRz": unpacked[11]
                        }
                        print(cartesian_info)

                        return (unpacked[:6], unpacked[6:])
                    elif ptype == 1:
                        """print(size)
                        format_str = "!dddddddddddd"
                        unpacked = struct.unpack(format_str, data[header_size:header_size + struct.calcsize(format_str)])
                        print(unpacked)
                        print("sdfs")
                        joint_info = {
                            "J0": math.degrees(unpacked[0]), "J1": math.degrees(unpacked[1]), "J2": math.degrees(unpacked[2]),
                            "J3": math.degrees(unpacked[3]), "J4": math.degrees(unpacked[4]), "J5": math.degrees(unpacked[5]),
                            "AJ0": math.degrees(unpacked[6]), "AJ1": math.degrees(unpacked[7]), "AJ2": math.degrees(unpacked[8]),
                            "AJ3": math.degrees(unpacked[9]), "AJ4": math.degrees(unpacked[10]), "AJ5": math.degrees(unpacked[11])
                        }
                        print(joint_info)
                        print("SSSSS"*20)
                        format_str = "!dddffffB dddffffB dddffffB dddffffB dddffffB dddffffB"
                        unpacked = struct.unpack(format_str, data[header_size:header_size + struct.calcsize(format_str)])
                        print(unpacked)
                        joint_info = {
                            "J0": math.degrees(unpacked[0]), "J1": math.degrees(unpacked[1]), "J2": math.degrees(unpacked[2]),
                            "J3": math.degrees(unpacked[3]), "J4": math.degrees(unpacked[4]), "J5": math.degrees(unpacked[5]),
                            "AJ0": math.degrees(unpacked[6]), "AJ1": math.degrees(unpacked[7]), "AJ2": math.degrees(unpacked[8]),
                            "AJ3": math.degrees(unpacked[9]), "AJ4": math.degrees(unpacked[10]), "AJ5": math.degrees(unpacked[11])
                        }
                        print(joint_info)
                        exit()"""
                        pass
                    data = data[size : ]

    except Exception as e:
        print(f"Error parsing Cartesian info: {e}")
    return None

def get_tcp_and_tool_offsets(robot_socket):
    """Requests and retrieves TCP position and tool offsets from the robot."""
    try:
        #while True:
        for i in range(5):
            data = robot_socket.recv(4096)
            if not data:
                break

            cartesian_info = parse_info(data)
            if cartesian_info:
                tcp_position, tool_config = cartesian_info
                print(f"TCP Position: {tcp_position}")
                print(f"Tool Offsets: {tool_config}")
                return tcp_position, tool_config
                break
            else:
                print("No Cartesian info found in the data")
        
        # if none found
        return None, None

    except Exception as e:
        print(f"Error retrieving data from the robot: {e}")

def connect_and_get(IP):
    host = IP  # Replace with your robot's IP address
    robot_socket = connect_to_ur_robot(host)

    if robot_socket:
        tcp , tool = get_tcp_and_tool_offsets(robot_socket)
        robot_socket.close()
        return tcp, tool


tcp, tool = connect_and_get(ip_address)
tcp = [x for x in tcp]
tool = [x for x in tool]
# ---------- end get_robot_position_2 ----------
robot_tcp_numbers = Number(get_robot_position_2.tcp)
tool_tcp_numbers = Number(get_robot_position_2.tool)

# ----
# Creating the Tool
construct_point = ConstructPoint(XCoordinate=-35, YCoordinate=0, ZCoordinate=49)
construct_point_2 = ConstructPoint(XCoordinate=-96, YCoordinate=0, ZCoordinate=55)
unit_z = UnitZ(Factor=-1)
unit_x = UnitX(Factor=1)
brep = Brep([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])
mesh_join = MeshJoin(Meshes=brep)
unit_y = UnitY(Factor=expr("x*-1", 1))
plane_normal = PlaneNormal(Origin=construct_point, ZAxis=expr("x*-1", Vector(0, 0, 1)))
construct_plane = ConstructPlane(Origin=construct_point_2, XAxis=unit_z, YAxis=unit_x)
align_plane = AlignPlane(Plane=plane_normal, Direction=unit_y)  # -> Plane, Angle
orient = Orient(Geometry=mesh_join, Source=PlaneXY(0, 0, 0), Target=align_plane.Plane)  # -> Geometry, Transform
volume = Volume(Geometry=mesh_join)  # -> Volume, Centroid
create_tool = CreateTool(Name="UR5_Thermoplastic_Extruder_90", TCP=construct_plane, Weight="0.72", Centroid=volume.Centroid, Mesh=orient.Geometry)  # -> Tool, TCP
update_tool = UpdateTool(GH_Tool=create_tool.Tool, TCP=create_tool.TCP, IsCtrl=False)

# ----
# Creating the Tool
brep_2 = Brep(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)
brep_3 = Brep(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)
unit_x_2 = UnitX(Factor=1)
solid_union = SolidUnion(Breps=[brep_2, brep_3])
unit_z_2 = UnitZ(Factor=expr("x*-1", 1))
mesh_brep = MeshBrep(
    Brep=solid_union,
    Settings={GridMaxCount=0, GridMinCount=16, JaggedSeams=False, MaxEdgeLength=0, MinEdgeLength=0.0001, MinTolerance=0, Refine=True, RefineAngle=0, RelativeTolerance=0.65, SimplePlanes=True, Tolerance=0})
point = Point(Point(0, 0, 196.7699975))
volume_2 = Volume(Geometry=mesh_brep)  # -> Volume, Centroid
construct_plane_2 = ConstructPlane(Origin=point, XAxis=unit_x_2, YAxis=unit_z_2)
create_tool_2 = CreateTool(Name="UR5_Thermoplastic_Extruder_0", TCP=construct_plane_2, Weight="0.72", Centroid=volume_2.Centroid, Mesh=mesh_brep)  # -> Tool, TCP
update_tool_2 = UpdateTool(GH_Tool=create_tool_2.Tool, TCP=create_tool_2.TCP, IsCtrl=False)

# ----
# Set Start Pose
# Comment: Set the Joint angles of the robot at the start of the Program.
joint_2_shoulder = Slider(-1.57, range=-6.28..6)
# Simulation and Motion Testing
joint_1_base = Slider(1.57, range=0..6)
joint_3_elbow = Slider(1.57, range=0..6)
joint_4_wrist_1 = Slider(0, range=-3.14..3.14)
joint_5_wrist_2 = Slider(1.57, range=-3.14..3.14)
joint_6_wrist_3 = Slider(0, range=0..6)
merge = Merge(
    Data1=joint_1_base,
    Data2=joint_2_shoulder,
    Data3=joint_3_elbow,
    Data4=joint_4_wrist_1,
    Data5=joint_5_wrist_2,
    Data6=joint_6_wrist_3)
text_join = TextJoin(Text=merge, Join=",")
create_target = CreateTarget(Joints=text_join, IsCartesian=False)
start_joint_target = TargetParameter(create_target)

# ----
# Toolpath Generation
# Import Model Waypoints
panel = Panel("C:\Users\pjvth\High-tech Engineering\Thesis\Non-Planar Models\ISM_toolpath.txt")
line_width = Slider(0.4, range=0..1)
line_count = Slider(4, range=1..10)
elevation = Slider(18, range=0..50)
yz_plane = YZPlane(Origin=Point(0, 0, 0))

# ----
# Distance from target frame
# origin to wrist center.
# Lower base
# Upper base
# Lower arm
brim_count = Slider(8, range=0..25)

python_3_script = Python3Script(
    filepath=panel,
    elevation=elevation,
    line_width=line_width,
    layer_height=average_layer_height,
    line_count=line_count,
    brim_count=brim_count)  # -> lines, section_heights; inputs filepath: String, line_width: Double, layer_height: Double, line_count: Int32
# ---------- python_3_script: Python ----------
import math
import Rhino.Geometry as rg
import Grasshopper as gh
from collections import defaultdict
import ghpythonlib.treehelpers as th

def parse_layers_from_txt(filepath):
    model = []
    with open(filepath, 'r') as file:
        lines = file.readlines()

    current_layer = []

    for line in lines:
        line = line.strip()
        if not line:
            continue

        if line.startswith("Nodes on the"):
            if current_layer:
                model.append(current_layer)
                current_layer = []
        else:
            try:
                x_str, z_str = line.split(',')
                point = [float(x_str.strip()), 0.0, float(z_str.strip()) + elevation]

                if len(current_layer) == 0:
                    current_layer.append(point)
                else:
                    dx = point[0] - current_layer[-1][0]
                    dz = point[2] - current_layer[-1][2]
                    dis = math.sqrt(dx*dx + dz*dz)

                    if dis > 0.5:
                        current_layer.append(point)

            except ValueError:
                pass

    if current_layer:
        model.append(current_layer)

    return model

def arc_length_resample(layer, n):
    if len(layer) == 1:
        return [layer[0]] * n

    cum = [0.0]
    for i in range(1, len(layer)):
        dx = layer[i][0] - layer[i-1][0]
        dy = layer[i][1] - layer[i-1][1]
        dz = layer[i][2] - layer[i-1][2]
        cum.append(cum[-1] + math.sqrt(dx*dx + dy*dy + dz*dz))

    total = cum[-1]
    result = []

    for j in range(n):
        t = j / (n - 1) * total if n > 1 else 0
        for k in range(1, len(cum)):
            if cum[k] >= t - 1e-9:
                seg_len = cum[k] - cum[k-1]
                local_t = (t - cum[k-1]) / seg_len if seg_len > 1e-9 else 0.0
                ix = layer[k-1][0] + local_t * (layer[k][0] - layer[k-1][0])
                iy = layer[k-1][1] + local_t * (layer[k][1] - layer[k-1][1])
                iz = layer[k-1][2] + local_t * (layer[k][2] - layer[k-1][2])
                result.append([ix, iy, iz])
                break

    return result

def interpolate_between(layer_a, layer_b, target_height, tolerance=0.05):
    z_a = sum(p[2] for p in layer_a) / len(layer_a)
    z_b = sum(p[2] for p in layer_b) / len(layer_b)
    gap = z_b - z_a

    if gap <= line_width*0.8: #max layer_height
        return []

    num_steps = int(round(gap / target_height))

    if num_steps <= 1 or abs(gap - target_height) <= tolerance:
        return []

    n = max(len(layer_a), len(layer_b))
    pts_a = arc_length_resample(layer_a, n)
    pts_b = arc_length_resample(layer_b, n)

    inserted = []
    for step in range(1, num_steps):
        t = step / num_steps
        interp = []
        for k in range(n):
            ix = pts_a[k][0] + t * (pts_b[k][0] - pts_a[k][0])
            iy = pts_a[k][1] + t * (pts_b[k][1] - pts_a[k][1])
            iz = pts_a[k][2] + t * (pts_b[k][2] - pts_a[k][2])
            interp.append([ix, iy, iz])
        inserted.append(interp)

    return inserted

def build_all_layers(base_z_coords, x_coords, y_base, model_layers, target_height, tolerance=0.05):
    base_layers = []
    for z in base_z_coords:
        base_layers.append([[x, y_base, z] for x in x_coords])

    all_layers = base_layers + model_layers

    result = [all_layers[0]]
    for i in range(1, len(all_layers)):
        interpolated = interpolate_between(all_layers[i-1], all_layers[i], target_height, tolerance)
        result.extend(interpolated)
        result.append(all_layers[i])

    return result

def get_brim_offsets(z_level, elevation, line_count, brim_count):
    if elevation > 0:
        taper = 1.0 - (z_level / elevation)
    else:
        taper = 0.0
    extra = int(round(brim_count * taper))
    return (
        list(range(-extra, 0)) +
        list(range(0, line_count)) +
        list(range(line_count, line_count + extra))
    )

def make_polyline(pts_base, y_offset_index, y_spacing, reverse):
    pts = [rg.Point3d(pt.X, pt.Y + y_offset_index * y_spacing, pt.Z) for pt in pts_base]
    if reverse:
        pts = list(reversed(pts))
    return rg.Polyline(pts)

def min_distance_point_to_polyline(px, pz, layer):
    min_dist = float('inf')
    for i in range(len(layer) - 1):
        ax, az = layer[i][0],   layer[i][2]
        bx, bz = layer[i+1][0], layer[i+1][2]

        dx, dz = bx - ax, bz - az
        seg_len_sq = dx*dx + dz*dz

        if seg_len_sq < 1e-12:
            dist = math.sqrt((px - ax)**2 + (pz - az)**2)
        else:
            t = ((px - ax)*dx + (pz - az)*dz) / seg_len_sq
            t = max(0.0, min(1.0, t))
            cx = ax + t * dx
            cz = az + t * dz
            dist = math.sqrt((px - cx)**2 + (pz - cz)**2)

        if dist < min_dist:
            min_dist = dist

    return min_dist

def find_outermost_base_points(layers):
    """
    For each layer, find the point with the minimum X (leftmost) and
    maximum X (rightmost). Among all layers, keep the one with the
    lowest Z for left and right separately.
    This gives the true outer base corners of the model.
    """
    left_point  = None  # [x, y, z] with smallest x, and among ties lowest z
    right_point = None  # [x, y, z] with largest x, and among ties lowest z

    for layer in layers:
        # Leftmost point in this layer
        lp = min(layer, key=lambda p: (p[0]))
        # Rightmost point in this layer
        rp = max(layer, key=lambda p: (p[0]))

        if left_point is None or lp[2] < left_point[2]:
            left_point = lp

        if right_point is None or rp[2] < right_point[2]:
            right_point = rp

    return left_point, right_point

# -----------------------------
# MAIN
# -----------------------------

layers = parse_layers_from_txt(filepath)

x_pt_spacing = 2

# --- Find outermost base points across all layers ---
# left_point = the point with the smallest X (and lowest Z among ties)
# right_point = the point with the largest X (and lowest Z among ties)
# These define where the elevation support lines must reach.
left_point, right_point = find_outermost_base_points(layers)

x_left  = left_point[0]
x_right = right_point[0]
y_base  = layers[0][0][1]

# --- Build base X points with ~2 spacing ---
x_span    = x_right - x_left
num_x_pts = max(2, int(round(x_span / x_pt_spacing)) + 1)
x_coords  = [x_left + i * (x_span / (num_x_pts - 1)) for i in range(num_x_pts)]

# --- Build Z levels for elevation base with layer_height spacing ---
z_coords = []
z = 0.0
while z <= elevation + 1e-9:
    z_coords.append(round(z, 6))
    z += layer_height
if not z_coords or z_coords[-1] < elevation - 1e-9:
    z_coords.append(round(elevation, 6))

# --- Combine base + model layers with full interpolation ---
all_layers = build_all_layers(z_coords, x_coords, y_base, layers, layer_height, tolerance=0.05)

num_base_layers = len(z_coords)

# -----------------------------
# STEP 1: Build per-layer data
# -----------------------------

layer_data = []

for idx, layer in enumerate(all_layers):
    pts_base = [rg.Point3d(p[0], p[1], p[2]) for p in layer]
    if len(pts_base) < 2:
        continue

    is_base = idx < num_base_layers
    z_level = sum(p[2] for p in layer) / len(layer)
    offsets = get_brim_offsets(z_level, elevation, line_count, brim_count) if is_base else list(range(line_count))

    layer_data.append((pts_base, sorted(offsets)))

# -----------------------------
# STEP 2: Build nested dictionary
# -----------------------------

nested_dict = defaultdict(dict)

for layer_idx, (pts_base, offsets) in enumerate(layer_data):
    for offset in offsets:
        nested_dict[layer_idx][offset] = make_polyline(pts_base, offset, line_width, reverse=False)

# -----------------------------
# STEP 3: Assign zigzag order
# Even layers: low -> high (left to right)
# Odd  layers: high -> low (right to left)
# -----------------------------

nested = []

for layer_idx, (pts_base, offsets) in enumerate(layer_data):
    if layer_idx % 2 == 0:
        ordered_offsets = sorted(offsets)
    else:
        ordered_offsets = sorted(offsets, reverse=True)

    branch = [nested_dict[layer_idx][offset] for offset in ordered_offsets]
    nested.append(branch)

# -----------------------------
# STEP 4: Output as GH DataTree
# -----------------------------

lines = th.list_to_tree(nested)

# -----------------------------
# STEP 5: Section view and heights
# -----------------------------

section_lines = []
section_heights = gh.DataTree[object]()

layer_idx_sh = 0

for i, layer in enumerate(all_layers):
    if len(layer) < 2:
        continue

    pts = [rg.Point3d(p[0], 0.0, p[2]) for p in layer]
    section_lines.append(rg.Polyline(pts))

    if i < len(all_layers) - 1:
        next_layer = all_layers[i + 1]
        if len(next_layer) < 2:
            heights = []
        else:
            heights = [min_distance_point_to_polyline(p[0], p[2], next_layer) for p in layer]
    else:
        heights = []

    if layer_idx_sh < len(nested):
        num_lines = len(nested[layer_idx_sh])
    else:
        num_lines = 1

    for line_idx in range(num_lines):
        path = gh.Kernel.Data.GH_Path(layer_idx_sh, line_idx)
        section_heights.AddRange(heights, path)

    layer_idx_sh += 1
# ---------- end python_3_script ----------
curve = Curve(python_3_script.lines)

tree_statistics = TreeStatistics(Tree=curve)  # -> Paths, Length, Count
list_item = ListItem(List=tree_statistics.Paths, Index=-1, Wrap=True)
split_tree = SplitTree(Data=curve, Masks=flatten(list_item))  # -> Positive, Negative

# ----
# Layer Heigth
# Forward facing
# Upper arm
# Wrist 1
# Wrist 2
# Wrist 3
clean_tree = CleanTree(RemoveNulls=True, RemoveInvalid=True, RemoveEmpty=True, Tree=python_3_script.section_heights)
divide_branches = DivideBranches(DataTree=clean_tree, DivisionPattern=[0, 1], RenumberPaths=False)  # -> reverse(Data0), Data1
merge_2 = Merge(Data1=divide_branches.Data0, Data2=divide_branches.Data1)
minimum = Minimum(A=merge_2, B=0.4)

stream_filter_2 = StreamFilter(Gate=0, Stream0=split_tree.Negative)

control_points = ControlPoints(Curve=stream_filter_2)  # -> simplify(Points), Weights, Knots
explode = Explode(Curve=stream_filter_2, Recursive=True)  # -> simplify(Segments), Vertices

plane_normal_2 = PlaneNormal(Origin=control_points.Points, ZAxis=explode.Segments)
align_planes = AlignPlanes(Planes=plane_normal_2, Master=yz_plane)
polyline_planes = Plane(align_planes)

data_dam = DataDam(DataDataA=polyline_planes, BufferDelay=10000000, BufferMode=0)
data_dam_2 = DataDam(DataDataA=stream_filter_2, BufferDelay=10000000, BufferMode=0)

# ----
# Define Buildplate
image_sampler = ImageSampler(Filter="Colour", Interpolate=False, Umax=1, Umin=0, Vmax=1, Vmin=0, Wrap=1)
robotsystem_parameter_2 = RobotSystemParameter(robotsystem_parameter)

# ----
# Point Right
tool_position_in_base = Panel("""-0.174837
-0.299956
0.010659
1.617121
-1.181569
-0.585365""")
get_plane = GetPlane(Numbers=tool_position_in_base, RobotSystem=robotsystem_parameter_2)
point_right_plane = Plane(get_plane)

# ----
# Origin
tool_position_in_base_2 = Panel("""-0.181397
-0.692988
0.012216
1.497538
-0.59083
-0.160192""")
get_plane_2 = GetPlane(Numbers=tool_position_in_base_2, RobotSystem=robotsystem_parameter_2)
origin_plane = Plane(get_plane_2)

# ----
# Point Down
tool_position_in_base_3 = Panel("""0.214996
-0.699338
0.011212
1.468675
0.26599
0.039995""")
get_plane_3 = GetPlane(Numbers=tool_position_in_base_3, RobotSystem=robotsystem_parameter_2)
point_down_plane = Plane(get_plane_3)

# ----
# Reorder for motion left-right
planes = Plane(data_dam)
tree_statistics_2 = TreeStatistics(Tree=planes)  # -> Paths, Length, Count; disabled
# Elbow up
multiplication = Multiplication(A=tree_statistics_2.Count, B=0.5)  # disabled
subtraction = Subtraction(A=multiplication, B=1)  # disabled
multiplication_2 = Multiplication(A=tree_statistics_2.Count, B=0.5)  # disabled
sequence = Sequence(Notation="[N-1] + 2 ", Length=subtraction, Initial=1)  # disabled
sequence_2 = Sequence(Notation="[N-1] + 2 ", Length=multiplication_2, Initial=0)  # disabled
# wrist center
tree_branch = TreeBranch(Tree=planes, Path=sequence, MaintainPaths=True)  # -> reverse(Branch); disabled
tree_branch_2 = TreeBranch(Tree=planes, Path=sequence_2, MaintainPaths=True)  # disabled

divide_branches_2 = DivideBranches(DataTree=planes, DivisionPattern=[0, 1], RenumberPaths=False)  # -> reverse(Data0), Data1

merge_3 = Merge(Data1=divide_branches_2.Data0, Data2=divide_branches_2.Data1)
planes_2 = Plane(merge_3)

# ----
# Measure TCP
# Comment: The Tool TCP Of your Probe
tool_tcp = Panel(tool_tcp_numbers)
robot_tcp_numbers_2 = Number(robot_tcp_numbers)
tool_tcp_numbers_2 = Number(tool_tcp_numbers)
tcp_probe = Panel("""0
-0.096
0.055
0
0
0""")
robotsystem_parameter_3 = RobotSystemParameter(robotsystem_parameter)

get_plane_4 = GetPlane(Numbers=tcp_probe, RobotSystem=robotsystem_parameter_3)
get_plane_5 = GetPlane(Numbers=tool_tcp_numbers_2, RobotSystem=robotsystem_parameter_3)
get_plane_6 = GetPlane(Numbers=robot_tcp_numbers_2, RobotSystem=robotsystem_parameter_3)
xy_plane = XYPlane(Origin=Point(0, 0, 0))
orient_2 = Orient(Geometry=xy_plane, Source=get_plane_5, Target=get_plane_6)  # -> Geometry, Transform
probe_plane = Plane(get_plane_4)
orient_3 = Orient(Geometry=probe_plane, Source=PlaneXY(0, 0, 0), Target=orient_2.Geometry)  # -> Geometry, Transform
from_plane = FromPlane(Plane=orient_3.Geometry, RobotSystem=robotsystem_parameter_3)
panel_2 = Panel("""1000
1000
1000
1
1
1""")
multiplication_3 = Multiplication(A=from_plane, B=panel_2)

real_world_plane = Plane(orient_3.Geometry)
position_in_m = Number(from_plane)
position_in_mm = Number(multiplication_3)
position_from_robot = Panel(position_in_m)

point_right_plane_2 = Plane(point_right_plane)
origin_plane_2 = Plane(origin_plane)
point_down_plane_2 = Plane(point_down_plane)

rectangle_3pt = Rectangle3Pt(PointA=origin_plane, PointB=point_right_plane, PointC=point_down_plane)  # -> Rectangle, Length
vector_2pt = Vector2Pt(PointA=origin_plane_2, PointB=point_right_plane_2, Unitize=False)  # -> Vector, Length
vector_2pt_2 = Vector2Pt(PointA=origin_plane_2, PointB=point_down_plane_2, Unitize=False)  # -> Vector, Length
centermark = Centermark(Plane=rectangle_3pt.Rectangle)  # -> Centermark, CenterPoint
reverse = Reverse(Vector=vector_2pt_2.Vector)
construct_plane_3 = ConstructPlane(Origin=centermark.CenterPoint, XAxis=vector_2pt.Vector, YAxis=reverse)
align_plane_2 = AlignPlane(Plane=construct_plane_3, Direction=vector_2pt_2.Vector)  # -> Plane, Angle

point_2 = Point(centermark.CenterPoint)

symbol_simple = SymbolSimple(Style=6, Size=5, Rotation=0, Colour=RGB(255, 0, 200))
symbol_display = SymbolDisplay(Location=construct_plane_3, Display=symbol_simple)

orient_target_plane = Plane(align_plane_2.Plane)

list_item_2 = ListItem(List=flatten(data_dam_2), Index=0, Wrap=True)
polygon_center = PolygonCenter(Polyline=list_item_2)  # -> CenterV, CenterE, CenterA
deconstruct_vector = DeconstructVector(Vector=polygon_center.CenterE)  # -> XComponent, YComponent, ZComponent
vector_xyz = VectorXYZ(XComponent=deconstruct_vector.XComponent, YComponent=0, ZComponent=0)  # -> Vector, Length

# ----
# Print Head Tilt Settings
# Orient to Location
# Comment: This Moves the Target Planes from the Base (0,0,0) Coordinate System to our Work Location.
toolpath_planes = Plane(planes_2)
xy_plane_2 = XYPlane(Origin=vector_xyz.Vector)
image_sampler_2 = ImageSampler(Filter="Colour", Interpolate=False, Umax=1, Umin=0, Vmax=1, Vmin=0, Wrap=1)

# ---- group: Rotate Target
# Comment: Rotate the Target Planes along their Z-Axis
image_sampler_3 = ImageSampler(Filter="Colour", Interpolate=False, Umax=1, Umin=0, Vmax=1, Vmin=0, Wrap=1)

# ---- group: Adjust Depth
z_shift = Slider(-1, range=-15..80)

unit_z_3 = UnitZ(Factor=1)
amplitude = Amplitude(Vector=unit_z_3, Amplitude=z_shift)

# ---- group: Division
# Servo Parameters
average_tool_speed_mm_s = Slider(4, range=1..20)

lookahead_time = Slider(0.06, range=0.02..0.25)
gain = Slider(1000, range=200..1200)

# ----
list_2 = FlagFields({"Shoulder": 1, "Elbow": 2, "Wrist": 4}, selected="Wrist")
list_3 = ValueList({"Joint", "Linear", "Process", "Servo"}, selected="Linear")
list_4 = ValueList({"Joint", "Linear", "Process", "Servo"}, selected="Linear")

# ----
# Create Targets
tool_parameter = ToolParameter(update_tool)
list_5 = ValueList({"Joint", "Linear", "Process", "Servo"}, selected="Servo")

move_in_x = Slider(17, range=-150..150)
y_rotation_normal = Slider(-11, range=-20..20)
move_in_y = Slider(-84, range=-150..150)
z_axis_rotation = Slider(7, range=-45..45)
opossum = Opossum(
    OpossumData_OptimizationType=0,
    OpossumData_ResultSerializationStatus=0,
    OpossumData_objective=c_script,
    OpossumData_variable=[move_in_x, y_rotation_normal, move_in_y, z_axis_rotation])

rotate = Rotate(Geometry=orient_target_plane, Angle=degrees(z_axis_rotation), Plane=orient_target_plane)  # -> Geometry, Transform
vector_xyz_2 = VectorXYZ(XComponent=move_in_x, YComponent=move_in_y, ZComponent=0)  # -> Vector, Length
move = Move(Geometry=rotate.Geometry, Motion=vector_xyz_2.Vector)  # -> Geometry, Transform

orient_4 = Orient(Geometry=toolpath_planes, Source=xy_plane_2, Target=move.Geometry)  # -> Geometry, Transform
oriented_planes = Plane(orient_4.Geometry)

# ---- group: Rotate Target (continued)
oriented_planes_2 = Plane(oriented_planes)

radians = Radians(Degrees=y_rotation_normal)
rotate_plane = RotatePlane(Plane=oriented_planes_2, Angle=radians)

oriented_rotated_planes = Plane(rotate_plane)

# ---- group: Adjust Depth (continued)
oriented_rotated_planes_2 = Plane(oriented_rotated_planes)

deconstruct_plane = DeconstructPlane(Plane=oriented_rotated_planes_2)  # -> Origin, XAxis, YAxis, ZAxis
move_2 = Move(Geometry=oriented_rotated_planes_2, Motion=amplitude)  # -> Geometry, Transform

oriented_rotated_planes_3 = Plane(move_2.Geometry)

# ---- group: Division (continued)
deconstruct_plane_2 = DeconstructPlane(Plane=oriented_rotated_planes_3)  # -> Origin, XAxis, YAxis, ZAxis
shift_list = ShiftList(List=deconstruct_plane_2.Origin, Shift=1, Wrap=False)
distance = Distance(PointA=deconstruct_plane_2.Origin, PointB=shift_list)
division = Division(SegmentDistance=distance, ToolSpeed=average_tool_speed_mm_s)  # -> flatten(Result)

average = Average(Input=division)
shift_list_2 = ShiftList(List=distance, Shift=-1, Wrap=True)

division_2 = Division(A=average, B=0.008)
round = Round(Number=division_2)  # -> Nearest, Floor, Ceiling
multiplication_4 = Multiplication(A=round.Nearest, B=0.008)
merge_4 = Merge(Data1=graft(multiplication_4), Data2=graft(lookahead_time), Data3=graft(gain))
text_join_2 = TextJoin(Text=merge_4, Join=",")

# ----
planes_3 = Plane(oriented_rotated_planes_3)

create_target_2 = CreateTarget(Plane=planes_3, RobConf=list_2, Motion=list_3, Tool=tool_parameter, IsCartesian=True)  # -> flatten(Target)
servo_parameters = ServoParameters(text_join_2)

c_script = CSharpScript(robotSystem=robotsystem_parameter, targets=create_target_2)  # -> travelCost, jointPoses; inputs targets: list
# ---------- c_script: C# ----------
#r "C:\Users\pjvth\AppData\Roaming\Grasshopper\Libraries\Robots-movep-servoj\artifacts\bin\Robots.Grasshopper\release\Robots.dll"

using System;
using System.Collections.Generic;
using System.Reflection;
using Robots;

{
    const double ERROR_PENALTY = 1e9;

    var robotSys = robotSystem as RobotSystem;
    if (robotSys == null)
    {
        travelCost = ERROR_PENALTY;
        jointPoses = null;
        return;
    }

    if (targets == null || targets.Count == 0)
    {
        travelCost = 0.0;
        jointPoses = null;
        return;
    }

    double totalCost = 0.0;
    int jointCount = -1;
    double[] previousJoints = null;
    var poseList = new List<string>();

    for (int i = 0; i < targets.Count; i++)
    {
        // Unwrap target using reflection to avoid GH wrapper namespace issues
        Target target = null;
        var raw = targets[i];

        if (raw is Target t)
        {
            target = t;
        }
        else
        {
            var valueProp = raw.GetType().GetProperty("Value");
            if (valueProp != null)
                target = valueProp.GetValue(raw) as Target;
        }

        if (target == null)
        {
            totalCost += ERROR_PENALTY;
            poseList.Add("error");
            previousJoints = null;
            continue;
        }

        // Pass previous joints as hint for consistent IK configuration
        IEnumerable<double[]> hints = (previousJoints != null)
            ? new[] { previousJoints }
            : null;

        // Solve IK
        IList<KinematicSolution> solutions;
        try
        {
            solutions = robotSys.Kinematics(new[] { target }, hints);
        }
        catch (Exception)
        {
            totalCost += ERROR_PENALTY;
            poseList.Add("error");
            previousJoints = null;
            continue;
        }

        var solution = solutions[0];

        // If any IK error (out of reach, axis limit, singularity) add penalty and continue
        if (solution.Errors != null && solution.Errors.Count > 0)
        {
            totalCost += ERROR_PENALTY;
            poseList.Add("error");
            previousJoints = null;
            continue;
        }

        double[] currentJoints = solution.Joints;

        if (jointCount < 0)
            jointCount = currentJoints.Length;

        // Format joint angles as "j1,j2,j3,j4,j5,j6"
        poseList.Add(string.Join(",", System.Array.ConvertAll(currentJoints, j => j.ToString("G7"))));

        // Accumulate absolute joint displacement
        if (previousJoints != null)
        {
            for (int j = 0; j < jointCount; j++)
                totalCost += System.Math.Abs(currentJoints[j] - previousJoints[j]);
        }

        previousJoints = currentJoints;
    }

    travelCost = totalCost;
    jointPoses = poseList;
}
# ---------- end c_script ----------
panel_3 = Panel(c_script.travelCost)

create_target_3 = CreateTarget(Joints=c_script.jointPoses, Motion=list_4, Tool=tool_parameter, IsCartesian=False)
create_target_4 = CreateTarget(Joints=c_script.jointPoses, Motion=list_5, Tool=tool_parameter, Servo=servo_parameters, IsCartesian=False)

# ----
# Upload 3D-printing Program
button = Button()
tree_statistics_3 = TreeStatistics(Tree=planes_3)  # -> Paths, Length, Count
panel_4 = Panel("C:\Users\pjvth\High-tech Engineering\Thesis\Grasshopper control\Grasshopper python scripts\GH_program_3Dprinting.script")
python_3_script_2 = Python3Script(
    P=c_script.jointPoses,
    H=flatten(minimum),
    D=flatten(shift_list_2),
    ROBOT_IP=robot_ip_txt,
    LAPTOP_IP="172.19.126.244",
    connect=button)  # -> out; inputs P: list of Double, H: list of Double, D: list of Double, ROBOT_IP: String, LAPTOP_IP: String, connect: Boolean
# ---------- python_3_script_2: Python ----------
import Grasshopper as gh
import socket

def parse_orientations_flat(P):
    waypoint_list = []
    
    for item in P:
        # Strip whitespace and ensure consistent formatting
        values = [float(v.strip()) for v in item.split(",")]
        coords = ", ".join(["{:.6f}".format(v) for v in values])
        waypoint_list.append(coords)
    
    return waypoint_list

def send_waypoint2robot(robot_ip, laptop_ip, P, H, D):
    # Your list of waypoints (can be thousands long)
    layer_heights = [str(item) for item in H]
    distances = [str(item) for item in D]
    waypoints = [str(item) for item in P]
    
    server = socket.socket(socket.AF_INET, socket.SOCK_STREAM)
    server.setsockopt(socket.SOL_SOCKET, socket.SO_REUSEADDR, 1)
    server.bind((laptop_ip, 3000))
    server.listen(1)

    print("Waiting for UR5 connection...")
    conn, addr = server.accept()
    print(f"Connected by {addr}")

    try:
        # 3. Use zip to iterate through all three lists at once
        for w, h, d in zip(waypoints, layer_heights, distances):
            # Wait for the request from the robot
            data = conn.recv(1024).decode()
            
            if "NEXT" in data:
                # Combine the data into one string per "NEXT" signal
                # Format: "(waypoint_data, height, distance)"
                message = f"({w}, {h}, {d})\n"
                conn.sendall(message.encode())
            else:
                # Optional: handle unexpected messages
                print(f"Unexpected data received: {data}")
                break

        # 4. Send the STOP signal after the loop finishes
        conn.sendall("STOP\n".encode())

    finally:
        # 5. Close the connection only after everything is done
        conn.close()
        server.close()
        print("Connection closed.")

if connect==True:
    send_waypoint2robot(ROBOT_IP, LAPTOP_IP, P, H, D)
# ---------- end python_3_script_2 ----------
panel_5 = Panel(python_3_script_2)
python_3_script_3 = Python3Script(
    T=multiplication_4,
    PPL=flatten(tree_statistics_3.Length),
    LT=lookahead_time,
    G=gain,
    filepath=panel_4,
    export=Button(),
    ROBOT_IP=robot_ip_txt,
    REMOTE_NAME="GH_3Dprinting.script")  # inputs T: list of String, PPL: list of String, LT: String, G: String, filepath: String, export: Boolean, REMOTE_NAME: String
# ---------- python_3_script_3: Python ----------
import Grasshopper as gh
import paramiko
import socket

def upload_program_to_robot(robot_ip, local_file_path, remote_filename):
    # Standard UR Credentials
    username = "root"
    password = "easybot" # Default for CB3. For e-Series, use your system admin password.
    port = 22

    print(f"Connecting to {robot_ip}...")

    try:
        # 1. Initialize SSH Client
        ssh = paramiko.SSHClient()
        ssh.set_missing_host_key_policy(paramiko.AutoAddPolicy()) # Automatically trust the robot's key
        ssh.connect(robot_ip, port, username, password)

        # 2. Initialize SFTP on top of SSH
        sftp = ssh.open_sftp()
        
        # 3. Define remote path (UR stores programs in /programs)
        remote_path = f"/programs/{remote_filename}"
        
        # 4. Upload the file
        print(f"Uploading {local_file_path} to {remote_path}...")
        sftp.put(local_file_path, remote_path)
        
        print("Upload Successful!")

        # 5. Close connections
        sftp.close()
        ssh.close()

    except Exception as e:
        print(f"An error occurred: {e}")

# --- Script Assembly ---
def assemble_program(PPL, G, T, LT):
    # 1. Header with Setup
    header = """def extrusion_program():
    socket_open("172.19.126.244", 3000, "laptop_socket")
    socket_open("172.19.126.242", 23, "duet_socket")
    sleep(1.5)
    set_tcp(p[0, -0.096, 0.055, 0, -1.5708, 0])
    set_payload(0.72, [0.01818, -0.00031, 0.01125])
    """

    # 2. Calculate the indentation to align exactly under the first 'p'  
    ppl_str =       "    global poses_per_layer = [" + ", ".join([x for x in PPL]) + "]"
    time_str =      "    global time = "+"".join([x for x in T])
    lt_str =        "    global lt = "+"".join([x for x in LT])
    gain_str =      "    global g = "+"".join([x for x in G])
    
    # 3. Footer (Logic and Loops)
    footer = """
    global extrusion_trigger = False
    global thread_val_E = 0
    global thread_val_F = 0 
    global target_pose = [0,0,0,0,0,0]
    global raw_data = [0,0,0,0,0,0,0,0,0]

    def fetch_next_pose():
        socket_send_string("NEXT", "laptop_socket")
        # We now expect 8 floats: [jointpose, height, distance]
        data = socket_read_ascii_float(8, "laptop_socket")
        textmsg("laptop data = ",data)
        return data
    end

    raw_data = fetch_next_pose()
    if raw_data[0] < 8:
        popup("Error: Could not fetch initial waypoint", "Error", error=True)
        halt
    end

    thread ExtruderControl():
        while True:
            if extrusion_trigger == True:
                socket_send_string("G1 E", "duet_socket")
                socket_send_string(thread_val_E, "duet_socket")
                socket_send_string(" F", "duet_socket")
                socket_send_string(thread_val_F, "duet_socket")
                socket_send_byte(10, "duet_socket")
                extrusion_trigger = False
            end
            sync()
        end
    end

    ext_thread_handle = run ExtruderControl()
    
    # Heating
    popup("For Heating and Priming Nozzle press CONTINUE.", "Set up hotend", blocking=True)
    socket_send_line("T0", "duet_socket")  
    socket_send_line("M109 S200", "duet_socket")
    socket_send_line("G1 E30 F300", "duet_socket")
    sleep(3)
    
    layer_idx = 0
    pose_pointer = 0
    num_layers = length(poses_per_layer)

    target_pose = [raw_data[1], raw_data[2], raw_data[3], raw_data[4], raw_data[5], raw_data[6]]

    popup("If Nozzle is primed press CONTINUE to move to the start position", "Start", blocking=True)
    movej(target_pose, a=1.0, v=0.1)

    keep_printing = True
    while keep_printing:
        while layer_idx < num_layers:
            poses_in_this_layer = poses_per_layer[layer_idx]
            i = 0

            while i < poses_in_this_layer:
                raw_data = fetch_next_pose()
                if raw_data[0] >= 6:
                    target_pose = [raw_data[1], raw_data[2], raw_data[3], raw_data[4], raw_data[5], raw_data[6]]
                    h = raw_data[7]
                    dist = raw_data[8]
                                       
                    thread_val_E = 0.075*((0.35 * h * dist)/0.126)
                    thread_val_F = (thread_val_E / time) * 60
                    extrusion_trigger = True

                    # Execute real-time motion
                    servoj(target_pose, t=time, lookahead_time=lt, gain=g)
                else:
                    textmsg("Warning: Failed to receive pose at pointer ", pose_pointer)
                    keep_printing = False
                    sync()
                end

                pose_pointer = pose_pointer + 1
                i = i + 1
                
            end
            layer_idx = layer_idx + 1
            sync()
        end 
        
    end

    kill ext_thread_handle 
    # Turn off heaters
    socket_send_line("T0", "duet_socket")  
    socket_send_line("M104 S0", "duet_socket")
    # socket_send_byte(10, "duet_socket")
    movej([1.57, -1.57, 1.57, 0, 1.57, 0], a=1, v=0.3, r=0)
    textmsg("Program finished and thread killed -> turn off hotend.")
    socket_close("duet_socket")
end
extrusion_program()
    """

    # Combine
    full_script = header  + "\n" + ppl_str + "\n" + gain_str + "\n" + lt_str + "\n" + time_str + "\n" + footer
    return full_script

# print(poses)
if export==True:
    with open(filepath, 'w') as f:
        f.write(assemble_program(PPL, G, T, LT))
    upload_program_to_robot(ROBOT_IP, filepath, REMOTE_NAME)
# ---------- end python_3_script_3 ----------

list_item_3 = ListItem(List=flatten(create_target_2), Index=0, Wrap=True)
merge_5 = Merge(Data1=flatten(list_item_3), Data2=flatten(create_target_4))
toolpath_targets = TargetParameter(merge_5)

# ----
# Merge Targets
start_joint_target_2 = TargetParameter(start_joint_target)
toolpath_targets_2 = TargetParameter(toolpath_targets)
merge_6 = Merge(Data1=start_joint_target_2, Data2=toolpath_targets_2, Data3=start_joint_target_2)
program_targets = TargetParameter(merge_6)

# ----
# Simulate Program
number_slider = Slider(0, range=-100..10)
mesh_plane = MeshPlane(Boundary=rectangle_3pt.Rectangle, WidthCount=10, HeightCount=10)  # -> Mesh, Area
merge_7 = Merge(Data1=start_joint_target_2, Data2=create_target_3)
simulation_time = Slider(0, range=0..1)
unit_z_4 = UnitZ(Factor=number_slider)
range = Range(Domain=Domain(0, 7), Steps=7)
move_3 = Move(Geometry=mesh_plane.Mesh, Motion=unit_z_4)  # -> Geometry, Transform

# ----
# Create Program
data_dam_3 = DataDam(DataDataA=program_targets, BufferDelay=10000000, BufferMode=0)
panel_6 = Panel("popup(\"press CONTINUE to start the program\", \"StartConfirmation\",warning=False, error=False, blocking=True)")
programname = Panel("Lshape_tuned")
custom_command = CustomCommand(Name="CustomCommand", Manufacturer="UR", Code=panel_6)
robotsystem_parameter_4 = RobotSystemParameter(robotsystem_parameter)
command_parameter = CommandParameter(custom_command)
target_parameter = TargetParameter(flatten(data_dam_3))

# ----
# Upload Motion Program
use_ftp_upload = BooleanToggle(True)
ftp_prefix = Panel("sftp://")
robot_ip_txt_3 = Text(robot_ip_txt)
concatenate = Concatenate(Fragment_A=ftp_prefix, Fragment_C=robot_ip_txt_3)
boolean = Boolean(use_ftp_upload)
upload = Button()
stream_filter_3 = StreamFilter(Gate=boolean, Stream0=robot_ip_txt_3, Stream1=concatenate)
gate_or = GateOr(B=upload)
robotip_txt = Text(stream_filter_3)
boolean_2 = Boolean(gate_or)

get_current_time = GetCurrentTime(get_time=boolean_2)  # -> out, time_string; inputs get_time: Boolean
# ---------- get_current_time: Python ----------
"""Provides a scripting component.
    Inputs:
       
    Output:
        a: The a output variable"""

__author__ = "robin godwyll"

import rhinoscriptsyntax as rs
from datetime import datetime 

def give_time(): 
    time = datetime.now()
    time_string = time.strftime("%m%d%H%M")
    return time_string
    
if get_time: 
    time_string = give_time()
# ---------- end get_current_time ----------
concatenate_2 = Concatenate(Fragment_A=programname, A=get_current_time.time_string)
create_program = CreateProgram(
    Name=concatenate_2,
    RobotSystem=robotsystem_parameter_4,
    Targets=target_parameter,
    InitCommands=command_parameter,
    StepSize=Slider(0.5, range=0..10))  # -> Program, Code, Duration, Warnings, Errors
program_parameter = ProgramParameter(create_program.Program)
program_duration = Number(create_program.Duration)
program_code = Text(create_program.Code)
warnings = Text(create_program.Warnings)
errors = Text(create_program.Errors)

create_program_2 = CreateProgram(Name=concatenate_2, RobotSystem=robotsystem_parameter, Targets=merge_7, StepSize=1)  # -> Program, Code, Duration, Warnings, Errors
program_simulation = ProgramSimulation(Program=create_program_2.Program, Time=simulation_time, Normalized=True)  # -> SystemMeshes, JointRotations, Plane, Index, Time, Program, Errors
check_collisions = CheckCollisions(
    Program=create_program_2.Program,
    FirstSet=range,
    SecondSet=8,
    Environment=move_3.Geometry,
    EnvironmentPlane=-1,
    LinearStepSize=100,
    AngularStepSize=0.7853981634)  # -> CollisionFound, TargetIndex, CollidedMeshes
panel_7 = Panel(create_program_2.Warnings)
panel_8 = Panel(check_collisions.CollisionFound)

panel_9 = Panel(check_collisions.TargetIndex)
mesh = Mesh(check_collisions.CollidedMeshes)

# ---- group: Robot Program Output
errors_2 = Text(errors)
code = Text(program_code)
warnings_2 = Text(warnings)
program_parameter_2 = ProgramParameter(program_parameter)

program_code_2 = Panel(code)
errors_3 = Panel(errors_2)
program = Panel(program_parameter_2)
warnings_3 = Panel(warnings_2)

# ----
program_parameter_3 = ProgramParameter(program_parameter)
remote_connection = RemoteConnection(Program=program_parameter_3, IP=robotip_txt, Upload=boolean_2, Play=False, Pause=False)
connection_log_txt = Text(remote_connection)
panel_10 = Panel(connection_log_txt)
