# Grasshopper definition servoj_ghScript.gh (Grasshopper 1.0.8)
# plug-ins: Robots, RobotsExtended, Anemone, Bifocals

# ----
# Alternative CAM Solution for Adaptive Robotic Additive Manufacturing, Štefčák et al., 2024
# Adapted by Stefan Lang, TU Delft / IDE
panel = Panel("https://www.actamechanica.sk/pdfs/ams/2024/04/08.pdf")
# Robot Template v 3.0
python_3_script = Python3Script(url=panel, btn=Button())
# ---------- python_3_script: Python ----------
## Simple Script for Opening URLs 

import subprocess
import sys

if btn:
    if not url:
        print("No URL provided.")
    else:
        try:
            # Windows-safe method: use cmd /c start
            subprocess.Popen(
                ['cmd', '/c', 'start', '', url],
                shell=True
            )
            print("Opening:", url)
        except Exception as e:
            print("Failed:", e)
# ---------- end python_3_script ----------

# ----
# Load Robot
list = RobotsLibrary({"UR3e", "UR5e", "UR10e", "UR16e", "UR3", "UR5", "UR10", "UR20", "UR30"}, selected="UR5", Type=0)
load_robot_system = LoadRobotSystem(Name=list, Base=PlaneXY(0, 0, 0))
robotsystem_parameter = RobotSystemParameter(load_robot_system)

# ----
# Send to Robot
choose_a_robot = ValueList({"Robotarm": 0, "Robotarm 2": 1}, selected="Robotarm")
robotarm_ip_address = Panel("172.19.126.241")
robotarm_2_ip_address = Panel("172.19.126.245")
stream_filter = StreamFilter(Gate=choose_a_robot, Stream0=robotarm_ip_address, Stream1=robotarm_2_ip_address)
robot_ip_txt = Text(stream_filter)

# ---- group: Get Data From RObot
get_robot_position = Button()
robot_ip_txt_2 = Text(robot_ip_txt)
get_robot_position_2 = Script(run=get_robot_position, ip_address=robot_ip_txt_2)  # -> out, tcp, tool; inputs run: Boolean, ip_address: String
# ---------- get_robot_position_2: Python ----------
import socket
import struct
import math
from datetime import datetime

def connect_to_ur_robot(host, port=30002):
    try:
        s = socket.create_connection((host, port), timeout=1.0)
        print(f"Connected to UR robot at {host}:{port}")
        return s
    except Exception as e:
        now = datetime.now()
        print(f"{now:%Y-%m-%d/%H:%M:%S}: Failed to connect to UR robot: {e}")
        return None

def parse_info(data):
    """Parses Cartesian info and tool offsets from the robot's data."""
    try:
        header_size = 5
        if len(data) > header_size:
            size, ptype = struct.unpack("!iB", data[:header_size])
            print(ptype, size)
            if ptype == 16: 
                print("Received Robot State Message" , size)
                data = data[header_size:]
                while data: 
                    print("Subpackage", "remaining data:", len(data))
                    size, ptype = struct.unpack("!iB", data[:header_size])
                    print("Subpackage type: ", ptype, size)
                    if ptype == 4: # Cartesian Information
                        format_str = "!dddddddddddd"
                        unpacked = struct.unpack(format_str, data[header_size:header_size + struct.calcsize(format_str)])
                        print(unpacked)
                        cartesian_info = {
                            "X": unpacked[0], "Y": unpacked[1], "Z": unpacked[2],
                            "Rx": unpacked[3], "Ry": unpacked[4], "Rz": unpacked[5],
                            "tcpOffsetX": unpacked[6], "tcpOffsetY": unpacked[7], "tcpOffsetZ": unpacked[8],
                            "tcpOffsetRx": unpacked[9], "tcpOffsetRy": unpacked[10], "tcpOffsetRz": unpacked[11]
                        }
                        print(cartesian_info)

                        return (unpacked[:6], unpacked[6:])
                    elif ptype == 1:
                        """print(size)
                        format_str = "!dddddddddddd"
                        unpacked = struct.unpack(format_str, data[header_size:header_size + struct.calcsize(format_str)])
                        print(unpacked)
                        print("sdfs")
                        joint_info = {
                            "J0": math.degrees(unpacked[0]), "J1": math.degrees(unpacked[1]), "J2": math.degrees(unpacked[2]),
                            "J3": math.degrees(unpacked[3]), "J4": math.degrees(unpacked[4]), "J5": math.degrees(unpacked[5]),
                            "AJ0": math.degrees(unpacked[6]), "AJ1": math.degrees(unpacked[7]), "AJ2": math.degrees(unpacked[8]),
                            "AJ3": math.degrees(unpacked[9]), "AJ4": math.degrees(unpacked[10]), "AJ5": math.degrees(unpacked[11])
                        }
                        print(joint_info)
                        print("SSSSS"*20)
                        format_str = "!dddffffB dddffffB dddffffB dddffffB dddffffB dddffffB"
                        unpacked = struct.unpack(format_str, data[header_size:header_size + struct.calcsize(format_str)])
                        print(unpacked)
                        joint_info = {
                            "J0": math.degrees(unpacked[0]), "J1": math.degrees(unpacked[1]), "J2": math.degrees(unpacked[2]),
                            "J3": math.degrees(unpacked[3]), "J4": math.degrees(unpacked[4]), "J5": math.degrees(unpacked[5]),
                            "AJ0": math.degrees(unpacked[6]), "AJ1": math.degrees(unpacked[7]), "AJ2": math.degrees(unpacked[8]),
                            "AJ3": math.degrees(unpacked[9]), "AJ4": math.degrees(unpacked[10]), "AJ5": math.degrees(unpacked[11])
                        }
                        print(joint_info)
                        exit()"""
                        pass
                    data = data[size : ]

    except Exception as e:
        print(f"Error parsing Cartesian info: {e}")
    return None

def get_tcp_and_tool_offsets(robot_socket):
    """Requests and retrieves TCP position and tool offsets from the robot."""
    try:
        #while True:
        for i in range(5):
            data = robot_socket.recv(4096)
            if not data:
                break

            cartesian_info = parse_info(data)
            if cartesian_info:
                tcp_position, tool_config = cartesian_info
                print(f"TCP Position: {tcp_position}")
                print(f"Tool Offsets: {tool_config}")
                return tcp_position, tool_config
                break
            else:
                print("No Cartesian info found in the data")
        
        # if none found
        return None, None

    except Exception as e:
        print(f"Error retrieving data from the robot: {e}")

def connect_and_get(IP):
    host = IP  # Replace with your robot's IP address
    robot_socket = connect_to_ur_robot(host)

    if robot_socket:
        tcp , tool = get_tcp_and_tool_offsets(robot_socket)
        robot_socket.close()
        return tcp, tool


tcp, tool = connect_and_get(ip_address)
tcp = [x for x in tcp]
tool = [x for x in tool]
# ---------- end get_robot_position_2 ----------
robot_tcp_numbers = Number(get_robot_position_2.tcp)
tool_tcp_numbers = Number(get_robot_position_2.tool)

# ----
# Creating the Tool
brep = Brep(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)
brep_2 = Brep(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)
unit_x = UnitX(Factor=1)
solid_union = SolidUnion(Breps=[brep, brep_2])
unit_z = UnitZ(Factor=expr("x*-1", 1))
mesh_brep = MeshBrep(
    Brep=solid_union,
    Settings={GridMaxCount=0, GridMinCount=16, JaggedSeams=False, MaxEdgeLength=0, MinEdgeLength=0.0001, MinTolerance=0, Refine=True, RefineAngle=0, RelativeTolerance=0.65, SimplePlanes=True, Tolerance=0})
point = Point(Point(0, 0, 196.7699975))
volume = Volume(Geometry=mesh_brep)  # -> Volume, Centroid
construct_plane = ConstructPlane(Origin=point, XAxis=unit_x, YAxis=unit_z)
create_tool = CreateTool(Name="UR5_Thermoplastic_Extruder_02", TCP=construct_plane, Weight="0.72", Centroid=volume.Centroid, Mesh=mesh_brep)  # -> Tool, TCP
update_tool = UpdateTool(GH_Tool=create_tool.Tool, TCP=create_tool.TCP, IsCtrl=False)

# ----
# Print Head Tilt Settings
unit_z_2 = UnitZ(Factor=1)

# ----
# Set Start Pose
# Comment: Set the Joint angles of the robot at the start of the Program.
joint_2_shoulder = Slider(-1.57, range=-6.28..6)
joint_1_base = Slider(1.57, range=0..6)
joint_3_elbow = Slider(1.57, range=0..6)
joint_4_wrist_1 = Slider(-1.57, range=-3.14..3.14)
joint_5_wrist_2 = Slider(-1.57, range=-3.14..3.14)
joint_6_wrist_3 = Slider(0, range=0..6)
merge = Merge(
    Data1=joint_1_base,
    Data2=joint_2_shoulder,
    Data3=joint_3_elbow,
    Data4=joint_4_wrist_1,
    Data5=joint_5_wrist_2,
    Data6=joint_6_wrist_3)
text_join = TextJoin(Text=merge, Join=",")
create_target = CreateTarget(Joints=text_join, IsCartesian=False)
start_joint_target = TargetParameter(create_target)

# ----
# Import Model Waypoints
elevation = Slider(0, range=0..50)
panel_2 = Panel("C:\Users\pjvth\High-tech Engineering\Thesis\Non-Planar Models\ISM_toolpath_reduced_waypoints.txt")
python_3_script_2 = Python3Script(filepath=panel_2, elevation=elevation)  # -> out, a; inputs filepath: String
# ---------- python_3_script_2: Python ----------
import math
import Rhino.Geometry as rg

def parse_layers_from_txt(filepath):
    model = []
    with open(filepath, 'r') as file:
        lines = file.readlines()

    current_layer = []

    for line in lines:
        line = line.strip()
        if not line:
            continue

        if line.startswith("Nodes on the"):
            if current_layer:
                model.append(current_layer)
                current_layer = []
        else:
            try:
                x_str, z_str = line.split(',')
                point = [float(x_str.strip()), 0.0, float(z_str.strip()) + elevation]

                if len(current_layer) == 0:
                    current_layer.append(point)
                else:
                    dx = point[0] - current_layer[-1][0]
                    dz = point[2] - current_layer[-1][2]
                    dis = math.sqrt(dx*dx + dz*dz)

                    if dis > 0.5:
                        current_layer.append(point)

            except ValueError:
                pass

    if current_layer:
        model.append(current_layer)

    return model

model = []
j = 0
y_base = 0.3 * j

while y_base <= elevation:
    layer = [[120, y_base], [150, y_base]]
    model.append(layer)
    j += 1
    y_base = 0.3*j
# -----------------------------
# MAIN
# -----------------------------

layers = parse_layers_from_txt(filepath)

polylines = []

for layer in layers:
    pts = []
    for p in layer:
        pts.append(rg.Point3d(p[0], p[1], p[2]))

    if len(pts) > 1:
        polylines.append(rg.Polyline(pts))
    
a = polylines

print(a)
# ---------- end python_3_script_2 ----------
curve = Curve(python_3_script_2.a)
scale = Scale(Geometry=curve, Center=Point(0, 0, 0), Factor=Slider(3.2, range=1..5))  # -> Geometry, Transform
simplify_curve = SimplifyCurve(Curve=scale.Geometry, Tolerance=0.02)  # -> Curve, Simplified
explode = Explode(Curve=simplify_curve.Curve, Recursive=True)  # -> Segments, Vertices
control_points = ControlPoints(Curve=simplify_curve.Curve)  # -> Points, Weights, Knots
yz_plane = YZPlane(Origin=Point(0, 0, 0))

# ----
# Evelation for Collision Prevention
end_points = EndPoints(Curve=simplify_curve.Curve)  # -> Start, End
polyline = PolyLine(Vertices=end_points.Start, Closed=False)
xy_plane = XYPlane(Origin=Point(0, 0, 0))
polyline_2 = PolyLine(Vertices=end_points.End, Closed=False)
extremes = Extremes(Curve=polyline, Plane=xy_plane)  # -> Highest, Lowest
extremes_2 = Extremes(Curve=polyline_2, Plane=xy_plane)  # -> Highest, Lowest
project_point = ProjectPoint(Point=extremes.Lowest, Direction=Vector(0, 0, -1), Geometry=xy_plane)  # -> Point, Index
project_point_2 = ProjectPoint(Point=extremes_2.Lowest, Direction=Vector(0, 0, -1), Geometry=xy_plane)  # -> Point, Index
merge_2 = Merge(Data1=extremes.Lowest, Data2=project_point.Point)
merge_3 = Merge(Data1=project_point_2.Point, Data2=extremes_2.Lowest)
division = Division(Elevation=elevation, LayerHeight=0.2)
polyline_3 = PolyLine(Vertices=merge_2, Closed=False)
polyline_4 = PolyLine(Vertices=merge_3, Closed=False)
divide_curve = DivideCurve(Curve=polyline_3, Count=division, Kinks=False)  # -> Points, Tangents, Parameters
divide_curve_2 = DivideCurve(Curve=polyline_4, Count=division, Kinks=False)  # -> reverse(Points), Tangents, Parameters
weave = Weave(Pattern=[0, 1, 1, 0], Stream0=divide_curve.Points, Stream1=divide_curve_2.Points, NullGaps=False)
polyline_5 = PolyLine(Vertices=weave, Closed=False)

merge_4 = Merge(Data1=weave, Data2=control_points.Points)
plane_normal = PlaneNormal(Origin=merge_4, ZAxis=explode.Segments)
align_planes = AlignPlanes(Planes=plane_normal, Master=yz_plane)
polyline_planes = Plane(align_planes)

# ----
# Retract First and last Plane
planes = Plane(simplify(polyline_planes))
list_item = ListItem(List=flatten(planes), Index=0, Wrap=True)  # -> Item1, Item
tree_statistics = TreeStatistics(Tree=planes)  # -> Paths, Length, Count
multiplication = Multiplication(A=tree_statistics.Count, B=0.5)
unit_z_3 = UnitZ(Factor=Slider(100, range=0..100))
subtraction = Subtraction(A=multiplication, B=1)
multiplication_2 = Multiplication(A=tree_statistics.Count, B=0.5)
move = Move(Geometry=list_item.Item1, Motion=unit_z_3)  # -> Geometry, Transform
move_2 = Move(Geometry=list_item.Item, Motion=unit_z_3)  # -> Geometry, Transform
sequence = Sequence(Notation="[N-1] + 2 ", Length=subtraction, Initial=1)
sequence_2 = Sequence(Notation="[N-1] + 2 ", Length=multiplication_2, Initial=0)
tree_branch = TreeBranch(Tree=planes, Path=sequence_2, MaintainPaths=True)
tree_branch_2 = TreeBranch(Tree=planes, Path=sequence, MaintainPaths=True)  # -> reverse(Branch)
merge_5 = Merge(Data1=tree_branch, Data2=tree_branch_2)
planes_2 = Plane(merge_5)

# ----
# Calculate Curvature Radii
plane = Plane(planes_2)
tree_statistics_2 = TreeStatistics(Tree=simplify(plane))  # -> Paths, graft(Length), Count
# Generation of Movement Points between Section D and C
subtraction_2 = Subtraction(A=tree_statistics_2.Length, B=1)
construct_domain = ConstructDomain(DomainStart=0, DomainEnd=subtraction_2)
range = Range(Domain=construct_domain, Steps=subtraction_2)  # -> simplify(Range)
stream_filter_2 = StreamFilter(Gate=Toggle(True), Stream0=Slider(1, range=0..6), Stream1=tree_statistics_2.Paths)
tree_branch_3 = TreeBranch(Tree=range, Path=stream_filter_2, MaintainPaths=True)
tree_item = TreeItem(Tree=simplify(plane), Path=graft(stream_filter_2), Index=tree_branch_3, Wrap=True)
nurbs_curve = NurbsCurve(Vertices=tree_item, Degree=2, Periodic=False)  # -> reparameterize(Curve), Length, Domain
# Slicing Curves
curve_closest_point = CurveClosestPoint(Point=tree_item, Curve=nurbs_curve.Curve)  # -> Point, Parameter, Distance
curvature = Curvature(Curve=nurbs_curve.Curve, Parameter=curve_closest_point.Parameter)  # -> Point, Curvature, Curvature_2
radial_dimension = RadialDimension(Curve=reparameterize(curvature.Curvature_2))  # -> simplify(RadialDimension)
# Vector Generation
bounds = Bounds(Numbers=radial_dimension)
deconstruct_domain = DeconstructDomain(Domain=bounds)  # -> Start, End
smallest_radius_of_curvature_in_layer = Panel(deconstruct_domain.Start)
panel_3 = Panel(radial_dimension)
data = Data(radial_dimension)

# ----
# Define Buildplate
image_sampler = ImageSampler(Filter="Colour", Interpolate=False, Umax=1, Umin=0, Vmax=1, Vmin=0, Wrap=1)
robotsystem_parameter_2 = RobotSystemParameter(robotsystem_parameter)

# ----
# Point Right
tool_position_in_base = Panel("""-0.174804
-0.315077
0.009059
1.2327
2.868966
0.087288""")
get_plane = GetPlane(Numbers=tool_position_in_base, RobotSystem=robotsystem_parameter_2)
point_right_plane = Plane(get_plane)

# ----
# Origin
tool_position_in_base_2 = Panel("""-0.180864
-0.673597
0.009886
-0.537726
-2.856868
0.310277""")
get_plane_2 = GetPlane(Numbers=tool_position_in_base_2, RobotSystem=robotsystem_parameter_2)
origin_plane = Plane(get_plane_2)

# ----
# Point Down
tool_position_in_base_3 = Panel("""0.181982
-0.67656
0.009488
-0.077117
2.939472
-0.325756""")
get_plane_3 = GetPlane(Numbers=tool_position_in_base_3, RobotSystem=robotsystem_parameter_2)
point_down_plane = Plane(get_plane_3)

# ----
# Measure TCP
tool_tcp = Panel(tool_tcp_numbers)

# ----
# Comment: The Tool TCP Of your Probe
robot_tcp_numbers_2 = Number(robot_tcp_numbers)
tool_tcp_numbers_2 = Number(tool_tcp_numbers)
tcp_probe = Panel("""0
0
0.195
0
0
0""")
robotsystem_parameter_3 = RobotSystemParameter(robotsystem_parameter)

get_plane_4 = GetPlane(Numbers=tcp_probe, RobotSystem=robotsystem_parameter_3)
get_plane_5 = GetPlane(Numbers=tool_tcp_numbers_2, RobotSystem=robotsystem_parameter_3)
get_plane_6 = GetPlane(Numbers=robot_tcp_numbers_2, RobotSystem=robotsystem_parameter_3)
xy_plane_2 = XYPlane(Origin=Point(0, 0, 0))
orient = Orient(Geometry=xy_plane_2, Source=get_plane_5, Target=get_plane_6)  # -> Geometry, Transform
probe_plane = Plane(get_plane_4)
orient_2 = Orient(Geometry=probe_plane, Source=PlaneXY(0, 0, 0), Target=orient.Geometry)  # -> Geometry, Transform
from_plane = FromPlane(Plane=orient_2.Geometry, RobotSystem=robotsystem_parameter_3)
panel_4 = Panel("""1000
1000
1000
1
1
1""")
multiplication_3 = Multiplication(A=from_plane, B=panel_4)

real_world_plane = Plane(orient_2.Geometry)
position_in_m = Number(from_plane)
position_in_mm = Number(multiplication_3)

position_from_robot = Panel(position_in_m)

point_right_plane_2 = Plane(point_right_plane)
origin_plane_2 = Plane(origin_plane)
point_down_plane_2 = Plane(point_down_plane)

rectangle_3pt = Rectangle3Pt(PointA=origin_plane, PointB=point_right_plane, PointC=point_down_plane)  # -> Rectangle, Length
vector_2pt = Vector2Pt(PointA=origin_plane_2, PointB=point_right_plane_2, Unitize=False)  # -> Vector, Length
vector_2pt_2 = Vector2Pt(PointA=origin_plane_2, PointB=point_down_plane_2, Unitize=False)  # -> Vector, Length
centermark = Centermark(Plane=rectangle_3pt.Rectangle)  # -> Centermark, CenterPoint
reverse = Reverse(Vector=vector_2pt_2.Vector)
construct_plane_2 = ConstructPlane(Origin=centermark.CenterPoint, XAxis=vector_2pt.Vector, YAxis=reverse)
align_plane = AlignPlane(Plane=construct_plane_2, Direction=vector_2pt_2.Vector)  # -> Plane, Angle

symbol_simple = SymbolSimple(Style=6, Size=5, Rotation=0, Colour=RGB(255, 0, 200))
symbol_display = SymbolDisplay(Location=construct_plane_2, Display=symbol_simple)

orient_target_plane = Plane(align_plane.Plane)

# ----
# Orient to Location
# Comment: This Moves the Target Planes from the Base (0,0,0) Coordinate System to our Work Location.
list_item_2 = ListItem(List=simplify_curve.Curve, Index=0, Wrap=True)
polygon_center = PolygonCenter(Polyline=list_item_2)  # -> CenterV, CenterE, CenterA
move_in_x = Slider(0, range=-100..100)
move_in_y = Slider(-6, range=-100..100)
deconstruct_vector = DeconstructVector(Vector=polygon_center.CenterE)  # -> XComponent, YComponent, ZComponent
vector_xyz = VectorXYZ(XComponent=deconstruct_vector.XComponent, YComponent=0, ZComponent=0)  # -> Vector, Length
vector_xyz_2 = VectorXYZ(XComponent=move_in_x, YComponent=move_in_y, ZComponent=0)  # -> Vector, Length
toolpath_planes = Plane(planes_2)
xy_plane_3 = XYPlane(Origin=vector_xyz.Vector)
move_3 = Move(Geometry=xy_plane_3, Motion=vector_xyz_2.Vector)  # -> Geometry, Transform
orient_target_plane_2 = Plane(orient_target_plane)
image_sampler_2 = ImageSampler(Filter="Colour", Interpolate=False, Umax=1, Umin=0, Vmax=1, Vmin=0, Wrap=1)
orient_3 = Orient(Geometry=toolpath_planes, Source=move_3.Geometry, Target=orient_target_plane_2)  # -> Geometry, Transform
oriented_planes = Plane(orient_3.Geometry)

# ---- group: Rotate Target
# Comment: Rotate the Target Planes along their Z-Axis
rotation = Slider(0, range=-360..360)
oriented_planes_2 = Plane(oriented_planes)
image_sampler_3 = ImageSampler(Filter="Colour", Interpolate=False, Umax=1, Umin=0, Vmax=1, Vmin=0, Wrap=1)

radians = Radians(Degrees=rotation)
rotate_plane = RotatePlane(Plane=oriented_planes_2, Angle=radians)

oriented_rotated_planes = Plane(rotate_plane)

# ---- group: Adjust Depth
z_shift = Slider(80, range=-2.5..80)
oriented_rotated_planes_2 = Plane(oriented_rotated_planes)

deconstruct_plane = DeconstructPlane(Plane=oriented_rotated_planes_2)  # -> Origin, XAxis, YAxis, ZAxis
amplitude = Amplitude(Vector=unit_z_2, Amplitude=z_shift)
move_4 = Move(Geometry=oriented_rotated_planes_2, Motion=amplitude)  # -> Geometry, Transform

oriented_rotated_planes_3 = Plane(move_4.Geometry)

# ----
# Set Speed
tool_speed_movep_mm_s = Slider(40, range=0..1000)
speed_compensation_factor = Slider(0.008, range=0..1)
tool_acceleration_movep_mm_s_2 = Slider(600, range=0..5000)
panel_5 = Panel(oriented_rotated_planes_3)
tool_acceleration_movep_mm_s_2_2 = Slider(651, range=0..5000)
tool_speed_movep_mm_s_2 = Slider(50, range=0..1000)
create_speed = CreateSpeed(
    Translation=tool_speed_movep_mm_s,
    Rotation=3.141592654,
    ExternalTranslation=5000,
    ExternalRotation=18.84955592,
    AccelTranslation=tool_acceleration_movep_mm_s_2,
    AccelAxis=12.56637061)
create_speed_2 = CreateSpeed(
    Translation=tool_speed_movep_mm_s_2,
    Rotation=tool_speed_movep_mm_s_2,
    ExternalTranslation=5000,
    ExternalRotation=18.84955592,
    AccelTranslation=tool_acceleration_movep_mm_s_2_2,
    AccelAxis=12.56637061)

deconstruct_plane_2 = DeconstructPlane(Plane=oriented_rotated_planes_3)  # -> Origin, XAxis, YAxis, ZAxis
shift_list = ShiftList(List=deconstruct_plane_2.Origin, Shift=1, Wrap=False)
distance = Distance(PointA=deconstruct_plane_2.Origin, PointB=shift_list)
division_2 = Division(A=distance, B=tool_speed_movep_mm_s)  # -> flatten(Result)
bounds_2 = Bounds(Numbers=division_2)
deconstruct_domain_2 = DeconstructDomain(Domain=bounds_2)  # -> Start, End

division_3 = Division(A=distance, B=2.05)
python_3_script_3 = Python3Script(
    tool_speed=tool_speed_movep_mm_s,
    tool_acceleration=tool_acceleration_movep_mm_s_2,
    speed_compensation_factor=speed_compensation_factor,
    rotation_tolerance=deconstruct_domain_2.Start,
    target_orientations=panel_5)  # -> Terminal, scaled_tool_speed, scaled_tool_acceleration; inputs tool_speed: Double, tool_acceleration: Double, speed_compensation_factor: Double, target_orientations: list of String
# ---------- python_3_script_3: Python ----------
import re

def parse_orientation_data(data_string):
    """Parse orientation data from the input string format."""
    orientations = []
    pattern = r'O\(([-\d.]+),([-\d.]+),([-\d.]+)\)\s+Z\(([-\d.]+),([-\d.]+),([-\d.]+)\)'
    
    for match in re.finditer(pattern, data_string):
        o_x, o_y, o_z = map(float, match.groups()[:3])
        z_x, z_y, z_z = map(float, match.groups()[3:])
        orientations.append({
            'O': (o_x, o_y, o_z),
            'Z': (z_x, z_y, z_z)
        })
    
    return orientations

def check_z_stability(z1, z2, tolerance):
    """Check if Z values are stable within tolerance."""
    diff = sum(abs(a - b) for a, b in zip(z1, z2))
    return diff <= tolerance

def scale_speed_and_acceleration(orientations, scale_factor, initial_speed, 
                                  initial_accel, z_tolerance):
    """
    Scale speed and acceleration based on Z-axis stability.
    
    Parameters:
    - orientations: List of orientation dictionaries with 'O' and 'Z' keys
    - scale_factor: Factor to scale speed/acceleration when Z is stable
    - initial_speed: Initial speed value
    - initial_accel: Initial acceleration value
    - z_tolerance: Maximum allowed change in Z values
    
    Returns:
    - List of dictionaries with target info, speed, and acceleration
    """
    scaled_tool_speed = []
    scaled_tool_acceleration = []
    for i, orientation in enumerate(orientations):
        # First target always uses initial values
        # if i == 0:
        #     speed = initial_speed
        #     acceleration = initial_accel
        #     z_stable = False
        # else:
            # Check if Z is stable compared to previous target
            prev_z = orientations[i-1]['Z']
            curr_z = orientation['Z']
            z_stable = check_z_stability(prev_z, curr_z, z_tolerance)
            
            # Scale if Z is stable, otherwise use initial values
            if z_stable:
                speed = initial_speed * scale_factor
                acceleration = initial_accel * scale_factor
            else:
                speed = initial_speed
                acceleration = initial_accel
        
            scaled_tool_speed.append(speed)

            scaled_tool_acceleration.append(acceleration)
    
    return scaled_tool_speed, scaled_tool_acceleration

# Example usage
if __name__ == "__main__":  
    # Parse and process
    orientations = parse_orientation_data(str(target_orientations))

    scaled_tool_motion = scale_speed_and_acceleration(
    orientations, 
    speed_compensation_factor, 
    tool_speed, 
    tool_acceleration, 
    rotation_tolerance
    )
    scaled_tool_speed = scaled_tool_motion[0]
    scaled_tool_acceleration = scaled_tool_motion[1]
# ---------- end python_3_script_3 ----------

# ---- group: Division
curvature_weighted_tool_speed = Slider(150, range=50..300)

# Servo Parameters
minimum_tool_speed_mm_s = Slider(5, range=5..60)
gain_weight_factor = Slider(7500, range=1000..100000)
minimum_gain = Slider(350, range=100..500)
lookahead_time_weight_factor = Slider(20000, range=20000..100000)
minimum_lookahead_time = Slider(0.03, range=0.01..0.08)
deconstruct_plane_3 = DeconstructPlane(Plane=oriented_rotated_planes_3)  # -> Origin, XAxis, YAxis, ZAxis
shift_list_2 = ShiftList(List=deconstruct_plane_3.Origin, Shift=1, Wrap=False)
distance_2 = Distance(PointA=deconstruct_plane_3.Origin, PointB=shift_list_2)
curvature_radius = Data(data)
division_4 = Division(DependancyFactor=gain_weight_factor, CurvatureRadius=curvature_radius)
division_5 = Division(SegmentDistance=curvature_radius, B=lookahead_time_weight_factor)
addition = Addition(ToolpathDependantGain=division_5, MinimumGain=minimum_lookahead_time)
addition_2 = Addition(ToolpathDependantGain=division_4, MinimumGain=minimum_gain)

division_6 = Division(A=curvature_radius, B=curvature_weighted_tool_speed)
addition_3 = Addition(A=division_6, B=minimum_tool_speed_mm_s)
minimum = Minimum(A=addition_3, B=20)

# ----
# Create Targets
planes_3 = Plane(oriented_rotated_planes_3)
list_length = ListLength(List=flatten(planes_3))
tool_parameter = ToolParameter(update_tool)
list_2 = ValueList({"Joint", "Linear", "Process", "Servo"}, selected="Servo")

subtraction_3 = Subtraction(A=list_length, B=1)
list_3 = ValueList({"Joint", "Linear", "Process", "Servo"}, selected="Linear")
create_target_2 = CreateTarget(Plane=planes_3, Motion=list_3, Tool=tool_parameter, IsCartesian=True)  # -> flatten(Target)

loop_start = LoopStart(Count=subtraction_3)  # -> port, Data, Counter
list_item_3 = ListItem(List=create_target_2, Index=loop_start.Counter, Wrap=False)
kinematics = Kinematics(RobotSystem=robotsystem_parameter, Target=list_item_3, PreviousJoints=loop_start.Data, DisplayGeometry=False)  # -> Meshes, Joints, Planes, Errors
loop_end = LoopEnd(port=loop_start.port, Data=kinematics.Joints, state="Last & Record")
list_item_4 = ListItem(List=flatten(create_target_2), Index=0, Wrap=True)

# ---- group: Division (continued)
division_7 = Division(SegmentDistance=distance_2, ToolSpeed=minimum)
division_8 = Division(A=division_7, B=0.008)

# ---- group: Division / Round
round = Round(Number=division_8)  # -> Nearest, Floor, Ceiling
minimum_2 = Minimum(A=addition, B=0.07)  # -> simplify(Result)

# ---- group: Division (continued)
multiplication_4 = Multiplication(A=round.Nearest, B=0.008)
maximum = Maximum(A=multiplication_4, B=0.16)
shift_list_3 = ShiftList(List=maximum, Shift=-1, Wrap=True)  # -> simplify(List)
merge_6 = Merge(Data1=graft(shift_list_3), Data2=graft(minimum_2), Data3=graft(addition_2))
text_join_2 = TextJoin(Text=merge_6, Join=",")

# ----
servo_parameters = ServoParameters(text_join_2)
create_target_3 = CreateTarget(Joints=loop_end, Motion=list_2, Tool=tool_parameter, Servo=servo_parameters, IsCartesian=False)

merge_7 = Merge(Data1=flatten(list_item_4), Data2=flatten(create_target_3))
toolpath_targets = TargetParameter(merge_7)

# ----
# Merge Targets
start_joint_target_2 = TargetParameter(start_joint_target)
toolpath_targets_2 = TargetParameter(toolpath_targets)
merge_8 = Merge(Data1=start_joint_target_2, Data2=toolpath_targets_2, Data3=start_joint_target_2)
program_targets = TargetParameter(merge_8)

# ----
# Create Program
panel_6 = Panel("popup(\"press CONTINUE to start the program\", \"StartConfirmation\",warning=False, error=False, blocking=True)")
data_dam = DataDam(DataDataA=program_targets, BufferDelay=10000000, BufferMode=0)
programname = Panel("Lshape_tuned")
custom_command = CustomCommand(Name="CustomCommand", Manufacturer="UR", Code=panel_6)
robotsystem_parameter_4 = RobotSystemParameter(robotsystem_parameter)
command_parameter = CommandParameter(custom_command)
number_slider = Slider(0.5, range=0..10)
target_parameter = TargetParameter(flatten(data_dam))

# ----
# Upload Program
ftp_prefix = Panel("sftp://")
robot_ip_txt_3 = Text(robot_ip_txt)
use_ftp_upload = BooleanToggle(True)
concatenate = Concatenate(Fragment_A=ftp_prefix, Fragment_C=robot_ip_txt_3)
boolean = Boolean(use_ftp_upload)
upload = Button()
stream_filter_3 = StreamFilter(Gate=boolean, Stream0=robot_ip_txt_3, Stream1=concatenate)
gate_or = GateOr(B=upload)
boolean_2 = Boolean(gate_or)
robotip_txt = Text(stream_filter_3)

get_current_time = GetCurrentTime(get_time=boolean_2)  # -> out, time_string; inputs get_time: Boolean
# ---------- get_current_time: Python ----------
"""Provides a scripting component.
    Inputs:
       
    Output:
        a: The a output variable"""

__author__ = "robin godwyll"

import rhinoscriptsyntax as rs
from datetime import datetime 

def give_time(): 
    time = datetime.now()
    time_string = time.strftime("%m%d%H%M")
    return time_string
    
if get_time: 
    time_string = give_time()
# ---------- end get_current_time ----------
concatenate_2 = Concatenate(Fragment_A=programname, A=get_current_time.time_string)
create_program = CreateProgram(
    Name=concatenate_2,
    RobotSystem=robotsystem_parameter_4,
    Targets=target_parameter,
    InitCommands=command_parameter,
    StepSize=number_slider)  # -> Program, Code, Duration, Warnings, Errors
program_parameter = ProgramParameter(create_program.Program)
program_duration = Number(create_program.Duration)
program_code = Text(create_program.Code)
warnings = Text(create_program.Warnings)
# Simulate Program
errors = Text(create_program.Errors)

# ---- group: Robot Program Output
errors_2 = Text(errors)
code = Text(program_code)
warnings_2 = Text(warnings)
program_parameter_2 = ProgramParameter(program_parameter)

program_code_2 = Panel(code)
errors_3 = Panel(errors_2)
program = Panel(program_parameter_2)
warnings_3 = Panel(warnings_2)

# ----
program_parameter_3 = ProgramParameter(program_parameter)
remote_connection = RemoteConnection(Program=program_parameter_3, IP=robotip_txt, Upload=boolean_2, Play=False, Pause=False)
connection_log_txt = Text(remote_connection)
panel_7 = Panel(connection_log_txt)

# ----
# Robot Code [EXPORT]
panel_8 = Panel(program_parameter)
panel_9 = Panel("C:\Users\pjvth\High-tech Engineering\Thesis\Grasshopper control\UR5 program files")
stream_gate = StreamGate(Stream=panel_9, Gate=Button())
save_program = SaveProgram(Program=program_parameter, Folder=stream_gate)

mesh_plane = MeshPlane(Boundary=rectangle_3pt.Rectangle, WidthCount=10, HeightCount=10)  # -> Mesh, Area
data_dam_2 = DataDam(DataDataA=create_target_2, BufferDelay=10000000, BufferMode=0)
create_program_2 = CreateProgram(Name=concatenate_2, RobotSystem=robotsystem_parameter_4, Targets=data_dam_2, StepSize=number_slider)  # -> Program, Code, Duration, Warnings, Errors
unit_z_4 = UnitZ(Factor=Slider(0, range=0..100))
move_5 = Move(Geometry=mesh_plane.Mesh, Motion=unit_z_4)  # -> Geometry, Transform
range_2 = Range(Domain=Domain(0, 7), Steps=7)
check_collisions = CheckCollisions(
    Program=create_program_2.Program,
    FirstSet=range_2,
    SecondSet=8,
    Environment=move_5.Geometry,
    EnvironmentPlane=-1,
    LinearStepSize=Slider(0.5, range=0..1),
    AngularStepSize=0.7853981634)  # -> CollisionFound, TargetIndex, CollidedMeshes
panel_10 = Panel(check_collisions.CollisionFound)
panel_11 = Panel(check_collisions.CollidedMeshes)

simulation_time = Slider(0, range=0..1)
program_simulation = ProgramSimulation(Program=create_program_2.Program, Time=simulation_time, Normalized=True)  # -> SystemMeshes, JointRotations, Plane, Index, Time, Program, Errors
index = Panel(program_simulation.Index)
time = Panel(program_simulation.Time)
number = Number(program_simulation.JointRotations)
plane_2 = Plane(program_simulation.Plane)
deconstruct_program_targets = DeconstructProgramTargets(Program=program_simulation.Program)  # -> Planes, Joints, Configuration, DeltaTime
add_rotation_tag_to_joints = AddRotationTagToJoints(joint_rotation=number, joint_planes=plane_2)
list_item_5 = ListItem(List=deconstruct_program_targets.Planes, Index=-1, Wrap=True)  # -> flatten(Item)
split_list = SplitList(List=list_item_5, Index=index)  # -> ListA, ListB
polyline_6 = PolyLine(Vertices=split_list.ListA, Closed=False)

merge_9 = Merge(
    Data1=ColourSwatch(SwatchColor=RGB(235, 38, 235)),
    Data2=ColourSwatch(SwatchColor=RGB(53, 222, 118)),
    Data3=ColourSwatch(SwatchColor=RGB(214, 36, 36)),
    Data4=ColourSwatch(SwatchColor=RGB(0, 76, 255)),
    Data5=ColourSwatch(SwatchColor=RGB(140, 227, 0)),
    Data6=ColourSwatch(SwatchColor=RGB(102, 102, 102)),
    Data7=ColourSwatch(SwatchColor=RGB(133, 43, 207)),
    Data8=ColourSwatch(SwatchColor=RGB(74, 74, 74)))
mesh = Mesh(program_simulation.SystemMeshes)
custom_preview = CustomPreview(Geometry=mesh, Material=merge_9)

# ==== cluster AddRotationTagToJoints
joint_rotation = ClusterInput()
joint_planes = ClusterInput()
joint_rotation_2 = Number(joint_rotation)
joint_planes_2 = Plane(joint_planes)
degrees = Degrees(Radians=joint_rotation_2)
absolute = Absolute(Value=degrees)
decimal_place = Panel("2")
round_to_decimal_place = RoundToDecimalPlace(NumberX=degrees, DecimalPlace=decimal_place, RoundType=0)  # -> Rounded, Difference
format_radians = Panel("({0:0.000 rad})")
division = Division(A=absolute, B="360")
format = Format(Format=format_radians, Culture=127, Data0=joint_rotation_2)
panel = Panel("""Base
Shoulder
Elbow
Wrist 1
Wrist 2
Wrist 3""")
gradient = Gradient(LowerLimit=0, UpperLimit=1, Parameter=division, stops=[0: RGB(19, 189, 0), 0.776: RGB(0, 39, 130), 1: RGB(220, 0, 40)])
concat = Concatenate(FragmentA=round_to_decimal_place.Rounded, FragmentB="°")
merge = Merge(Data1=simplify(graft(panel)), Data2=simplify(graft(concat)))
newline = Panel("")
text_join = TextJoin(Text=merge, Join=newline)
text_tag = TextTag(Location=graft(joint_planes_2), Text=text_join, Colour=graft(gradient))
